# Grasshopper definition A1_adityakossambe_Default.gh (Grasshopper 1.0.8)

# ----
# Default Values
number_slider = Slider(0.05, range=0..5)
v_count = Slider(20, range=0..25)
u_count = Slider(20, range=0..25)
surface_ripple_frequency = Slider(10, range=0..25)
surface_rib_amplitude = Slider(0.05, range=0..0.25)

ripple_amplitude = GetNumber(
    surface_rib_amplitude,
    AtLeast=1,
    AtMost=1,
    Maximum=1.797693135e+308,
    Minimum=-1.797693135e+308,
    Prompt="Ripple amplitude on surface",
    TreeAccess=False)
v_max_bound = GetNumber(
    Slider(2, range=0..2),
    AtLeast=1,
    AtMost=1,
    Maximum=1.797693135e+308,
    Minimum=-1.797693135e+308,
    Prompt="Max domain of Pi",
    TreeAccess=False)
v_min_bound = GetNumber(
    Slider(0, range=0..2),
    AtLeast=1,
    AtMost=1,
    Maximum=1.797693135e+308,
    Minimum=-1.797693135e+308,
    Prompt="Min domain of Pi",
    TreeAccess=False)
# Inputs
u_min = GetNumber(
    number_slider,
    AtLeast=1,
    AtMost=1,
    Maximum=1.797693135e+308,
    Minimum=-1.797693135e+308,
    Prompt="Min radius value",
    TreeAccess=False)
u_max = GetNumber(
    Slider(1, range=0..2),
    AtLeast=1,
    AtMost=1,
    Maximum=1.797693135e+308,
    Minimum=-1.797693135e+308,
    Prompt="Max radius value",
    TreeAccess=False)

u_count_2 = GetInteger(u_count, AtLeast=1, AtMost=1, Maximum=25, Minimum=1, Prompt="Surface subdivision count 'u'", TreeAccess=False)
v_count_2 = GetInteger(v_count, AtLeast=1, AtMost=1, Maximum=25, Minimum=1, Prompt="Surface subdivision count 'v'", TreeAccess=False)
ripple_freq = GetInteger(
    surface_ripple_frequency,
    AtLeast=1,
    AtMost=1,
    Maximum=25,
    Minimum=1,
    Prompt="Ripple frequency on surface",
    TreeAccess=False)
# Ripple Parameters
panel = Panel("0")

multiplication = Multiplication(A=ripple_freq, B="Pi")
dom = ConstructDomain(DomainStart=panel, DomainEnd=multiplication)
range = Range(Domain=dom, Steps=expr("x-1", u_count_2))
sin = Sine(Value=range)
multiplication_2 = Multiplication(A=sin, B=ripple_amplitude)

py3 = Python3Script(u_min=u_min, u_max=u_max, u_count=u_count_2, v_min_bound=v_min_bound, v_max_bound=v_max_bound, v_count=v_count_2)  # -> out, a, b, c; inputs u_min: Double, u_max: Double, u_count: Int32, v_min_bound: Double, v_max_bound: Double, v_count: Int32
# ---------- py3: Python ----------
import Rhino.Geometry as rg
import math

#Define base parameters of min max and count values

#u_min 
#u_max 
#u_count

v_min = math.pi * v_min_bound
v_max = math.pi * v_max_bound
#v_count

# Define range for radius 'r' and angle 'phi'

#domain of r here is restricted from a non zero rational number to a number below 
r_range = [u_min + i * (u_max - u_min) / (u_count - 1) for i in range (u_count)]

#domain of phi here is restricted from 0 to 2Pi to avoid repeating overlaps
phi_range = [v_min + i * (v_max - v_min) / (v_count - 1) for i in range (v_count)]


#initialize points list
points = []

# Build equations to populate points for Enneper's Minimal Surface

for r in r_range:
    for phi in phi_range:

        x = r * math.cos(phi) - (1/3) * (r**3) * math.cos(3 * phi) 
        y = r * math.sin(phi) - (1/3) * (r**3) * math.sin(3 * phi) 
        z = (r**2) * math.cos(2 * phi)
        point = rg.Point3d(x,y,z)
        points.append(point)        
      

a=points
b=r_range
c=phi_range
# ---------- end py3 ----------

# ----
# Base Surface
srfgrid = SurfaceFromPoints(Points=py3.a, UCount=u_count_2, Interpolate=invert(False))  # -> reparameterize(Surface)

partition = PartitionList(List=py3.a, Size=v_count_2)  # -> simplify(Chunks)

# ----
# Surface Ripple Creation
flip = FlipMatrix(Data=partition)
srf_cp = SurfaceClosestPoint(Point=flip, Surface=srfgrid)  # -> Point, UVPoint, Distance
evalsrf = EvaluateSurface(Surface=reparameterize(srfgrid), Point=srf_cp.UVPoint)  # -> Point, Normal, UDirection, VDirection, Frame
amp = Amplitude(Vector=evalsrf.Normal, Amplitude=multiplication_2)
move = Move(Geometry=srf_cp.Point, Motion=amp)  # -> simplify(Geometry), Transform
tstat = TreeStatistics(Tree=move.Geometry)  # -> Paths, Length, Count
cull_i = CullIndex(List=tstat.Paths, Indices="-1", Wrap=True)
branch = TreeBranch(Tree=move.Geometry, Path=cull_i, MaintainPaths=True)  # -> simplify(Branch)
branch_2 = TreeBranch(Tree=move.Geometry, Path="{0}", MaintainPaths=True)
merge = Merge(Data1=flatten(branch), Data2=branch_2)

srfgrid_2 = SurfaceFromPoints(Points=flatten(merge), UCount=v_count_2, Interpolate=False)  # -> reparameterize(Surface)
preview = CustomPreview(
    Geometry=srfgrid_2,
    Material={diffuse=RGB(221, 160, 221), emission=RGB(66, 48, 66), shine=0.5, specular=RGB(255, 255, 255), transparency=0})
c_bake = ContextBake(Content=srfgrid_2)
