# Grasshopper definition A1_adityakossambe_Hops.gh (Grasshopper 1.0.8)
# plug-ins: Hops

web_address = Panel("https://github.com/iaac-macad/bimsc26-datamgmt-session01/raw/refs/heads/homework/adityakossambe/A1_adityakossambe_Default.gh")
path = FilePath(web_address)
v_count = Slider(20, range=0..25)
u_count = Slider(20, range=0..25)
surface_ripple_frequency = Slider(11, range=0..25)
surface_rib_amplitude = Slider(0.05, range=0..0.25)
hops = Hops(
    _Path=path,
    U_min=Slider(0.05, range=0..5),
    U_max=Slider(1, range=0..2),
    U_count=v_count,
    V_count=u_count,
    V_min_bound=Slider(0, range=0..2),
    V_max_bound=Slider(2, range=0..2),
    Ripple_freq=surface_ripple_frequency,
    Ripple_amplitude=surface_rib_amplitude,
    CacheResultsInMemory=True,
    CacheSolveResults=True,
    RemoteDefinitionLocation="https://github.com/iaac-macad/bimsc26-datamgmt-session01/raw/refs/heads/homework/adityakossambe/A1_adityakossambe_Default.gh",
    RemoteSolveVersion=(0, 1, 0),
    ShowInput_Enabled=False,
    ShowInput_Path=True,
    SynchronousSolve=True)
preview = CustomPreview(
    Geometry=hops,
    Material={diffuse=RGB(221, 160, 221), emission=RGB(66, 48, 66), shine=0.5, specular=RGB(255, 255, 255), transparency=0})
