# Grasshopper definition Assignment1-Hanikarime.gh (Grasshopper 1.0.8)
# plug-ins: LunchBox

length = GetNumber(Slider(10, range=0..20), AtLeast=1, AtMost=1, Maximum=1.797693135e+308, Minimum=-1.797693135e+308, TreeAccess=False)

# ----
# Base Points
number_slider = Slider(20, range=0..40)
construct_point = ConstructPoint(XCoordinate=0, YCoordinate=0, ZCoordinate=0)
series = Series(Start=0, Step=length, Count=number_slider)
unit_y = UnitY(Factor=series)
move = Move(Geometry=construct_point, Motion=unit_y)  # -> Geometry, Transform

width = GetNumber(Slider(80, range=0..100), AtLeast=1, AtMost=1, Maximum=1.797693135e+308, Minimum=-1.797693135e+308, TreeAccess=False)

height = GetNumber(Slider(20, range=0..20), AtLeast=1, AtMost=1, Maximum=1.797693135e+308, Minimum=-1.797693135e+308, TreeAccess=False)

# ----
# Z Direction Graph Mapper
range = Range(Domain=Domain(0, 1), Steps=expr("X-1", number_slider))
graph_mapper = GraphMapper(range, x0=0, x1=1, y0=0, y1=1, container_name="Sine", Equation_px=[0, 0.262011528], Equation_py=[0, 1])
construct_domain = ConstructDomain(DomainStart=Slider(0, range=0..20), DomainEnd=height)
bounds = Bounds(Numbers=graph_mapper)
remap_numbers = RemapNumbers(Value=graph_mapper, Source=bounds, Target=construct_domain)  # -> Mapped, Clipped
panel = Panel(construct_domain)
unit_z = UnitZ(Factor=1)
amplitude = Amplitude(Vector=unit_z, Amplitude=remap_numbers.Mapped)
move_2 = Move(Geometry=move.Geometry, Motion=amplitude)  # -> Geometry, Transform
interpolate = Interpolate(Vertices=move_2.Geometry, Degree=3, Periodic=False, KnotStyle=1)  # -> Curve, Length, Domain

# ----
# Second Curve
construct_point_2 = ConstructPoint(XCoordinate=width, YCoordinate=0, ZCoordinate=0)
series_2 = Series(Start=0, Step=length, Count=number_slider)
unit_y_2 = UnitY(Factor=series_2)
move_3 = Move(Geometry=construct_point_2, Motion=unit_y_2)  # -> Geometry, Transform
construct_domain_2 = ConstructDomain(DomainStart=height, DomainEnd=height)
remap_numbers_2 = RemapNumbers(Value=graph_mapper, Source=bounds, Target=construct_domain_2)  # -> Mapped, Clipped
unit_z_2 = UnitZ(Factor=1)
amplitude_2 = Amplitude(Vector=unit_z_2, Amplitude=remap_numbers_2.Mapped)
move_4 = Move(Geometry=move_3.Geometry, Motion=amplitude_2)  # -> Geometry, Transform
interpolate_2 = Interpolate(Vertices=move_4.Geometry, Degree=3, Periodic=False, KnotStyle=1)  # -> Curve, Length, Domain

loft = Loft(
    Curves=[interpolate.Curve, interpolate_2.Curve],
    Options={Adjust=False, Closed=False, LoftEnds=0, LoftSimp=0, LoftType=0, Rebuild=10, Refit=0.01})

panel_size = GetNumber(Slider(6, range=1.5..6), AtLeast=1, AtMost=1, Maximum=1.797693135e+308, Minimum=-1.797693135e+308, TreeAccess=False)

# ----
# Lunch Box Panels
dimensions = Dimensions(Surface=loft)  # -> UDimension, VDimension
division = Division(A=dimensions.UDimension, B=Slider(3, range=1.5..6))
division_2 = Division(A=dimensions.VDimension, B=panel_size)
diamond_panels = DiamondPanels(Surface=loft, UDivisions=division, VDivisions=division_2)  # -> DiamondPanels, TriPanels

curve = Curve(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)

panel_opening_size_1 = GetNumber(Slider(0.7, range=0..1), AtLeast=1, AtMost=1, Maximum=1.797693135e+308, Minimum=-1.797693135e+308, TreeAccess=False)
panel_opening_size_2 = GetNumber(Slider(0.3, range=0..1), AtLeast=1, AtMost=1, Maximum=1.797693135e+308, Minimum=-1.797693135e+308, TreeAccess=False)
construct_domain_3 = ConstructDomain(DomainStart=panel_opening_size_1, DomainEnd=panel_opening_size_2)

panel_extrusion = GetNumber(Slider(2, range=0..2), AtLeast=1, AtMost=1, Maximum=1.797693135e+308, Minimum=-1.797693135e+308, TreeAccess=False)

# ----
# Geometry
panel_2 = Panel("0.5,0.5,0.5")
area = Area(Geometry=diamond_panels.DiamondPanels)  # -> Area, Centroid
evaluate_surface = EvaluateSurface(Surface=reparameterize(diamond_panels.DiamondPanels), Point=panel_2)  # -> Point, Normal, UDirection, VDirection, Frame
amplitude_3 = Amplitude(Vector=evaluate_surface.Normal, Amplitude=panel_extrusion)
brep_edges = BrepEdges(Brep=diamond_panels.DiamondPanels)  # -> Naked, Interior, NonManifold

# ----
# Attractor
project = Project(Curve=curve, Brep=loft, Direction=Vector(0, 0, 1))
pull_point = PullPoint(Point=area.Centroid, Geometry=project, ClosestOnly=True)  # -> ClosestPoint, Distance, Index
bounds_2 = Bounds(Numbers=pull_point.Distance)
remap_numbers_3 = RemapNumbers(Value=pull_point.Distance, Source=bounds_2, Target=construct_domain_3)  # -> Mapped, Clipped

scale = Scale(Geometry=diamond_panels.DiamondPanels, Center=area.Centroid, Factor=remap_numbers_3.Mapped)  # -> Geometry, Transform
move_5 = Move(Geometry=scale.Geometry, Motion=amplitude_3)  # -> Geometry, Transform
brep_edges_2 = BrepEdges(Brep=move_5.Geometry)  # -> Naked, Interior, NonManifold
ruled_surface = RuledSurface(CurveA=brep_edges.Naked, CurveB=brep_edges_2.Naked)
brep_join = BrepJoin(Breps=ruled_surface)  # -> flatten(Breps), Closed

area_2 = Area(Geometry=move_5.Geometry)  # -> Area, Centroid
unit_z_3 = UnitZ(Factor=Slider(10, range=5..15))
member_index = MemberIndex(Set=area_2.Centroid, Member=area_2.Centroid)  # -> flatten(Index), Count
move_6 = Move(Geometry=area_2.Centroid, Motion=unit_z_3)  # -> Geometry, Transform
deconstruct_plane = DeconstructPlane(Plane=move_6.Geometry)  # -> Origin, XAxis, YAxis, ZAxis
construct_plane = ConstructPlane(Origin=deconstruct_plane.Origin, XAxis=deconstruct_plane.XAxis, YAxis=deconstruct_plane.ZAxis)
line = Line(StartPoint=area_2.Centroid, EndPoint=move_6.Geometry)

c_bake = ContextBake(Content=brep_join.Breps)

bounds_3 = Bounds(Numbers=remap_numbers_3.Mapped)
deconstruct_domain = DeconstructDomain(Domain=bounds_3)  # -> Start, End
gradient = Gradient(
    LowerLimit=deconstruct_domain.Start,
    UpperLimit=deconstruct_domain.End,
    Parameter=remap_numbers_3.Mapped,
    stops=[0: RGB(80, 55, 25), 0.396: RGB(159, 65, 29), 1: RGB(174, 166, 129)])
custom_preview = CustomPreview(Geometry=brep_join.Breps, Material=gradient)
custom_preview_2 = CustomPreview(Geometry=move_5.Geometry, Material=ColourSwatch(SwatchColor=RGBA(255, 255, 255, 150)))

text_tag_3d = TextTag3D(
    Location=construct_plane,
    Text=member_index.Index,
    Size="1.2",
    Colour=ColourSwatch(SwatchColor=RGB(0, 0, 0)),
    Justification=7)
custom_preview_3 = CustomPreview(Geometry=line, Material=ColourSwatch(SwatchColor=RGB(191, 191, 191)))
