# Grasshopper definition CBDM-LakzhmyMariZaro-01-HW-multipipe.gh (Grasshopper 1.0.8)

polygon_radius = GetNumber(Slider(30, range=30..150), AtLeast=1, AtMost=1, Maximum=1.797693135e+308, Minimum=-1.797693135e+308, TreeAccess=False)
polygon_segments = GetNumber(Slider(6, range=3..12), AtLeast=1, AtMost=1, Maximum=1.797693135e+308, Minimum=-1.797693135e+308, TreeAccess=False)
polygon_fillet = GetNumber(Slider(11, range=1..30), AtLeast=1, AtMost=1, Maximum=1.797693135e+308, Minimum=-1.797693135e+308, TreeAccess=False)
polygon = Polygon(Plane=PlaneXY(0, 0, 0), Radius=polygon_radius, Segments=polygon_segments, FilletRadius=polygon_fillet)  # -> Polygon, Length
curve = Curve(polygon.Polygon)

explode = Explode(Curve=curve, Recursive=True)  # -> Segments, Vertices
height = GetNumber(Slider(65, range=1..100), AtLeast=1, AtMost=1, Maximum=1.797693135e+308, Minimum=-1.797693135e+308, TreeAccess=False)
u_division = GetNumber(Slider(3, range=1..10), AtLeast=1, AtMost=1, Maximum=1.797693135e+308, Minimum=-1.797693135e+308, TreeAccess=False)
v_division = GetNumber(Slider(13, range=5..20), AtLeast=1, AtMost=1, Maximum=1.797693135e+308, Minimum=-1.797693135e+308, TreeAccess=False)
length = Length(Curve=explode.Segments)
unit_z = UnitZ(Factor=height)
division = Division(A=length, B=v_division)  # -> graft(Result)
extrude = Extrude(Base=explode.Segments, Direction=unit_z)  # -> graft(Extrusion)
divide_domain² = DivideDomain²(Domain=extrude, UCount=u_division, VCount=division)
isotrim = Isotrim(Surface=extrude, Domain=divide_domain²)
deconstruct_brep = DeconstructBrep(Brep=isotrim)  # -> Faces, Edges, Vertices
md_slider = MDSlider(SliderMode=0, slider_value=Point(0.5, 0.5, 0.5), x_domain=Domain(0, 1), y_domain=Domain(0, 1), z_domain=Domain(0, 1))
evaluate_surface = EvaluateSurface(Surface=reparameterize(deconstruct_brep.Faces), Point=md_slider)  # -> Point, Normal, UDirection, VDirection, Frame
vector_display = VectorDisplay(Anchor=evaluate_surface.Point, Vector=evaluate_surface.Normal)
line = Line(StartPoint=graft(evaluate_surface.Point), EndPoint=deconstruct_brep.Vertices)
node_size = GetNumber(Slider(1.43, range=0.8..3), AtLeast=1, AtMost=1, Maximum=1.797693135e+308, Minimum=-1.797693135e+308, TreeAccess=False)
strut_size = GetNumber(Slider(0.36, range=0.01..1), AtLeast=1, AtMost=1, Maximum=1.797693135e+308, Minimum=-1.797693135e+308, TreeAccess=False)
multipipe = MultiPipe(Curves=flatten(line), NodeSize=node_size, EndOffset=1, StrutSize=strut_size, Segment=0, KinkAngle=0.6, CubeFit=0, Caps=0)

context_bake = ContextBake(Content=multipipe)
