# Grasshopper definition ChristmasTree.gh (Grasshopper 1.0.8)

# ---- group: DEFAULT VALUES
tree_offset_height_cm = Slider(1.5, range=0..5)
tree_height_cm = Slider(30, range=0..100)
branch_thickness_cm = Slider(0.3, range=0..1)
trunk_radius_cm = Slider(0.2, range=-0.6..0.4)
branch_width_cm = Slider(1, range=0..2)
rotation = Slider(520, range=0..720)

# ---- group: INPUT
tree_height_cm_2 = GetNumber(tree_height_cm, AtLeast=1, AtMost=1, Maximum=1.797693135e+308, Minimum=-1.797693135e+308, TreeAccess=False)
tree_offset_height_cm_2 = GetNumber(tree_offset_height_cm, AtLeast=1, AtMost=1, Maximum=1.797693135e+308, Minimum=-1.797693135e+308, TreeAccess=False)
trunk_radius_cm_2 = GetNumber(trunk_radius_cm, AtLeast=1, AtMost=1, Maximum=1.797693135e+308, Minimum=-1.797693135e+308, TreeAccess=False)
branch_thickness_cm_2 = GetNumber(branch_thickness_cm, AtLeast=1, AtMost=1, Maximum=1.797693135e+308, Minimum=-1.797693135e+308, TreeAccess=False)
branch_width_cm_2 = GetNumber(branch_width_cm, AtLeast=1, AtMost=1, Maximum=1.797693135e+308, Minimum=-1.797693135e+308, TreeAccess=False)
rotation_2 = GetNumber(rotation, AtLeast=1, AtMost=1, Maximum=1.797693135e+308, Minimum=-1.797693135e+308, TreeAccess=False)

# ---- group: VERTICAL LINE
height = Number(tree_height_cm_2)
pt = ConstructPoint(XCoordinate="0", YCoordinate="0", ZCoordinate="0")
pt_2 = ConstructPoint(XCoordinate="0", YCoordinate="0", ZCoordinate=height)
end_pt = Point(pt_2)
start_pt = Point(pt)
ln = Line(StartPoint=start_pt, EndPoint=end_pt)

# ---- group: NUMBER OF BRANCH
thickness = Number(branch_thickness_cm_2)
height_2 = Number(tree_height_cm_2)
division = Division(A=height_2, B=thickness)
branch_number = Number(division)
divide = DivideCurve(Curve=ln, Count=branch_number, Kinks=False)  # -> Points, Tangents, Parameters

# ---- group: BOUNDARY SHAPE
branch_number_2 = Number(branch_number)
range = Range(Domain=Domain(0, 1), Steps=branch_number_2)
graph = GraphMapper(range, x0=0, x1=1, y0=10, y1=1, Cx=1, Cy=1, container_name="Conic")
cir = Circle(Plane=divide.Points, Radius=graph)

# ---- group: BRANCH RECTANGULAR SHAPE
divide_2 = DivideCurve(Curve=cir, Count="2", Kinks=False)  # -> Points, Tangents, Parameters
item = ListItem(List=divide_2.Points, Index="1", Wrap=True)
item_2 = ListItem(List=divide_2.Points, Index=0, Wrap=True)
pdecon = Deconstruct(Point=item)  # -> XComponent, YComponent, ZComponent
width = Number(branch_width_cm_2)
division_2 = Division(A=width, B="2")
pt_3 = ConstructPoint(XCoordinate=pdecon.XComponent, YCoordinate=division_2, ZCoordinate=pdecon.ZComponent)
rec_3pt = Rectangle3Pt(PointA=item_2, PointB=item, PointC=pt_3)  # -> Rectangle, Length

# ---- group: PIPE TRUNK
offset_height = Number(tree_offset_height_cm_2)
height_3 = Number(tree_height_cm_2)
addition = Addition(A=height_3, B=offset_height)
pt_4 = ConstructPoint(XCoordinate=0, YCoordinate=0, ZCoordinate=addition)
start_pt_2 = Point(start_pt)
ln_2 = Line(StartPoint=start_pt_2, EndPoint=pt_4)
trunk_radius = Number(trunk_radius_cm_2)
pipe = Pipe(Curve=ln_2, Radius=trunk_radius, Caps=0, FitRail=False)
trunk = Geometry(pipe)

# ---- group: MIRROR
xz = XZPlane(Origin=Point(0, 0, 0))
mirror = Mirror(Geometry=rec_3pt.Rectangle, Plane=xz)  # -> Geometry, Transform
join = BrepJoin(Breps=[mirror.Geometry, rec_3pt.Rectangle])  # -> Breps, Closed

# ---- group: EXTRUSION
thickness_2 = Number(branch_thickness_cm_2)
Z = UnitZ(Factor=thickness_2)
extr = Extrude(Base=join.Breps, Direction=Z)

# ----
sdiff = SolidDifference(BrepsA=extr, BrepsB=trunk)  # -> flatten(Result)

rotation_3 = Number(rotation_2)
branch_number_3 = Number(branch_number)
dom = ConstructDomain(DomainStart=0, DomainEnd=rotation_3)
range_2 = Range(Domain=dom, Steps=expr("x-1", branch_number_3))
rot3d = Rotate3D(Geometry=sdiff, Angle=degrees(range_2), Center=Point(0, 0, 0), Axis=Vector(0, 0, 1))  # -> Geometry, Transform
branches = Geometry(rot3d.Geometry)

merge = Merge(Data1=trunk, Data2=branches)
christmas_tree = Geometry(merge)
c_bake = ContextBake(Geometry=christmas_tree)
