# Grasshopper definition ChristmasTree_Hops.gh (Grasshopper 1.0.8)
# plug-ins: Hops

panel = Panel("https://github.com/iaac-macad/bimsc26-datamgmt-session01/raw/refs/heads/homework/andreacutroni/ChristmasTree.gh")
path = FilePath(panel)
hops = Hops(
    _Path=path,
    TreeHeightCm=Slider(50, range=0..100),
    TreeOffsetHeightCm=Slider(1, range=0..1),
    BranchThicknessCm=Slider(0.3, range=0..1),
    BranchWidthCm=Slider(1, range=0..1),
    Rotation=Slider(360, range=0..1000),
    TrunkRadiusCm=Slider(0.2, range=0..1),
    CacheResultsInMemory=True,
    CacheSolveResults=True,
    RemoteDefinitionLocation="https://github.com/iaac-macad/bimsc26-datamgmt-session01/raw/refs/heads/homework/andreacutroni/ChristmasTree.gh",
    RemoteSolveVersion=(0, 1, 0),
    ShowInput_Enabled=False,
    ShowInput_Path=True,
    SynchronousSolve=True)
geo = Geometry(hops)
