# Grasshopper definition Data management_Assignment-01_Sushmitha_Ravi.gh (Grasshopper 1.0.8)

# ---- group: Sliders
steps = GetInteger(Slider(60, range=0..100), AtLeast=1, AtMost=1, Maximum=2147483647, Minimum=-2147483648, TreeAccess=False)
rd = GetNumber(Slider(4, range=0..10), AtLeast=1, AtMost=1, Maximum=1.797693135e+308, Minimum=-1.797693135e+308, TreeAccess=False)
z_unit = GetNumber(Slider(2, range=0..10), AtLeast=1, AtMost=1, Maximum=1.797693135e+308, Minimum=-1.797693135e+308, TreeAccess=False)
sd = GetNumber(Slider(0, range=0..100), AtLeast=1, AtMost=1, Maximum=1.797693135e+308, Minimum=-1.797693135e+308, TreeAccess=False)
ed = GetNumber(Slider(10, range=0..10), AtLeast=1, AtMost=1, Maximum=1.797693135e+308, Minimum=-1.797693135e+308, TreeAccess=False)

# ---- group: Geometry
xz_plane = XZPlane(Origin=Point(4, 0, 0))
polygon = Polygon(Plane=xz_plane, Radius=rd, Segments=3, FilletRadius=0)  # -> Polygon, Length
rotate = Rotate(Geometry=polygon.Polygon, Angle=1.570796327, Plane=xz_plane)  # -> Geometry, Transform
unit_z = UnitZ(Factor=z_unit)
move = Move(Geometry=rotate.Geometry, Motion=unit_z)  # -> Geometry, Transform
explode = Explode(Curve=move.Geometry, Recursive=True)  # -> Segments, flatten(Vertices)
list_item = ListItem(List=explode.Segments, Index=0, Wrap=True)  # -> Item, Item1, Item2
list_item_2 = ListItem(List=explode.Vertices, Index=0, Wrap=True)  # -> Item, Item1, Item2
point_on_curve = PointOnCurve(list_item.Item2, parameter=0.75)
point_on_curve_2 = PointOnCurve(list_item.Item, parameter=0.25)
construct_domain = ConstructDomain(DomainStart=sd, DomainEnd=ed)
line = Line(StartPoint=point_on_curve_2, EndPoint=list_item_2.Item1)
line_2 = Line(StartPoint=list_item_2.Item1, EndPoint=list_item_2.Item2)
line_3 = Line(StartPoint=point_on_curve_2, EndPoint=list_item_2.Item2)
line_4 = Line(StartPoint=point_on_curve, EndPoint=list_item_2.Item1)
line_5 = Line(StartPoint=list_item_2.Item1, EndPoint=list_item_2.Item2)
line_6 = Line(StartPoint=point_on_curve, EndPoint=list_item_2.Item2)
range = Range(Domain=construct_domain, Steps=steps)
merge = Merge(Data1=line, Data2=line_3, Data3=line_2)  # -> flatten(Result)
merge_2 = Merge(Data1=line_4, Data2=line_6, Data3=line_5)  # -> flatten(Result)
join_curves = JoinCurves(Curves=merge, Preserve=False)
unit_y = UnitY(Factor=range)
join_curves_2 = JoinCurves(Curves=merge_2, Preserve=False)
unit_y_2 = UnitY(Factor=range)
move_2 = Move(Geometry=join_curves, Motion=unit_y)  # -> Geometry, Transform
graph_mapper = GraphMapper(range, x0=0, x1=10, y0=0, y1=10, container_name="Sine", Equation_px=[0, 0.2709683478], Equation_py=[0, 0.1414169073])
move_3 = Move(Geometry=join_curves_2, Motion=unit_y_2)  # -> Geometry, Transform
explode_2 = Explode(Curve=move_2.Geometry, Recursive=True)  # -> Segments, Vertices
vector_xyz = VectorXYZ(XComponent=graph_mapper, YComponent=0, ZComponent=0)  # -> Vector, Length
graph_mapper_2 = GraphMapper(
    range,
    x0=0,
    x1=10,
    y0=0,
    y1=10,
    container_name="Sine",
    Equation_px=[0.04177717865, 0.3063562512],
    Equation_py=[0.1398615241, 0.01838040352])
explode_3 = Explode(Curve=move_3.Geometry, Recursive=True)  # -> Segments, Vertices
list_item_3 = ListItem(List=explode_2.Vertices, Index=0, Wrap=True)  # -> flatten(Item)
vector_xyz_2 = VectorXYZ(XComponent=graph_mapper_2, YComponent=0, ZComponent=0)  # -> Vector, Length
move_4 = Move(Geometry=list_item_3, Motion=vector_xyz.Vector)  # -> Geometry, Transform
list_item_4 = ListItem(List=explode_2.Vertices, Index=2, Wrap=True)  # -> flatten(Item)
list_item_5 = ListItem(List=explode_2.Vertices, Index=1, Wrap=True)  # -> flatten(Item)
list_item_6 = ListItem(List=explode_3.Vertices, Index=0, Wrap=True)  # -> flatten(Item)
list_item_7 = ListItem(List=explode_3.Vertices, Index=1, Wrap=True)  # -> flatten(Item)
move_5 = Move(Geometry=list_item_6, Motion=vector_xyz_2.Vector)  # -> Geometry, Transform
list_item_8 = ListItem(List=explode_3.Vertices, Index=2, Wrap=True)  # -> flatten(Item)
line_7 = Line(StartPoint=list_item_4, EndPoint=move_4.Geometry)
line_8 = Line(StartPoint=list_item_5, EndPoint=move_4.Geometry)
line_9 = Line(StartPoint=list_item_8, EndPoint=move_5.Geometry)
line_10 = Line(StartPoint=list_item_7, EndPoint=move_5.Geometry)
join_curves_3 = JoinCurves(Curves=[line_9, line_10], Preserve=False)
join_curves_4 = JoinCurves(Curves=[line_7, line_8], Preserve=False)
pipe = Pipe(Curve=[join_curves_3, join_curves_4], Radius=0.06, Caps=1, FitRail=True)

# ----
bounds = Bounds(Numbers=graph_mapper)
remap_numbers = RemapNumbers(Value=graph_mapper, Source=bounds, Target=Domain(0, 5))  # -> Mapped, Clipped
gradient = Gradient(LowerLimit=0, UpperLimit=1, Parameter=remap_numbers.Clipped, stops=[0: RGB(255, 255, 255), 1: RGB(0, 0, 0)])

# ---- group: Geometry (continued)
mesh_colours = MeshColours(Mesh=pipe, Colours=gradient)

# ---- group: output
context_bake = ContextBake(Content=mesh_colours)
