# Grasshopper definition EleniMaglari_S3.01.gh (Grasshopper 1.0.8)
# plug-ins: Hops

length = Slider(24, range=0..50)
width = Slider(22, range=0..50)
height = Slider(20, range=0..50)
box = Hops(
    GetFilePath="C:\Users\etmaglari\IAAC\bimsc26-datamgmt-session01",
    Length=length,
    Width=width,
    Height=height,
    CacheResultsInMemory=True,
    CacheSolveResults=True,
    RemoteDefinitionLocation="C:\Users\etmaglari\IAAC\bimsc26-datamgmt-session01\box.gh",
    RemoteSolveVersion=(0, 1, 0),
    ShowInput_Enabled=False,
    ShowInput_Path=False,
    SynchronousSolve=True)  # -> Geometry, Volume, Centroid
geometry = Geometry(box.Geometry)
panel = Panel(box.Volume)
centroid = Point(box.Centroid)
