# Grasshopper definition Euclidian Steps.gh (Grasshopper 1.0.8)

number_slider = Slider(2.66, range=1..10)
point = Point(Point(0, 1, 0))
# 01 Base Geometrica
rectangular = Rectangular(
    Plane=point,
    SizeX=number_slider,
    SizeY=number_slider,
    ExtentX=expr("x-1", Slider(8, range=2..40)),
    ExtentY=expr("x-1", Slider(8, range=2..40)))  # -> flatten(Cells), flatten(Points)

polygon_segments = GetInteger(Slider(6, range=3..6), AtLeast=1, AtMost=1, Maximum=2147483647, Minimum=-2147483648, TreeAccess=False)

polygon = Polygon(Plane=rectangular.Points, Radius=Slider(0.74, range=0.3..1), Segments=polygon_segments, FilletRadius=0)  # -> Polygon, Length

# ----
# 03 Jitter
number_slider_2 = Slider(0.594, range=0..1)
list_length = ListLength(List=polygon.Length)
series = Series(Start=Slider(2, range=1..10), Step=Slider(0.04, range=0..0.1), Count=list_length)

jitter_steps = GetNumber(number_slider_2, AtLeast=1, AtMost=1, Maximum=1.797693135e+308, Minimum=-1.797693135e+308, TreeAccess=False)
sees_steps = GetInteger(Slider(35, range=1..60), AtLeast=1, AtMost=1, Maximum=2147483647, Minimum=-2147483648, TreeAccess=False)

jitter = Jitter(List=series, Jitter=jitter_steps, Seed=sees_steps)  # -> Values, Indices

# ----
# 03 Accion
boundary_surfaces = BoundarySurfaces(Edges=polygon.Polygon)
unit_z = UnitZ(Factor=jitter.Values)
extrude = Extrude(Base=boundary_surfaces, Direction=unit_z)

context_print = ContextPrint(Results=extrude)
