# Grasshopper definition HW.1_HOPS_Parametric Tower_01.gh (Grasshopper 1.0.8)
# plug-ins: Hops

panel = Panel("https://github.com/iaac-macad/bimsc26-datamgmt-session01/raw/refs/heads/homework/RamonGarcia/HW.1_Parametric%20Tower_01.gh")

path = FilePath(panel)
hops = Hops(
    _Path=path,
    Radius=Slider(5, range=1..10),
    Segments=Slider(4, range=3..5),
    Height=Slider(15, range=1..20),
    Frames=Slider(5, range=1..10),
    CacheResultsInMemory=True,
    CacheSolveResults=True,
    RemoteDefinitionLocation="https://github.com/iaac-macad/bimsc26-datamgmt-session01/raw/refs/heads/homework/RamonGarcia/HW.1_Parametric%20Tower_01.gh",
    RemoteSolveVersion=(0, 1, 0),
    ShowInput_Enabled=False,
    ShowInput_Path=True,
    SynchronousSolve=True)
