# Grasshopper definition HW.1_Parametric Tower_01.gh (Grasshopper 1.0.8)

height = GetInteger(Slider(58, range=0..100), AtLeast=1, AtMost=1, Maximum=2147483647, Minimum=-2147483648, TreeAccess=False)

Z = UnitZ(Factor=height)
pt = Point(Point(0, 0, 0))
move = Move(Geometry=pt, Motion=Z)  # -> Geometry, Transform

frames = GetInteger(Slider(4, range=0..20), AtLeast=1, AtMost=1, Maximum=10, Minimum=-2147483648, TreeAccess=False)

ln = Line(StartPoint=pt, EndPoint=move.Geometry)

segments = GetInteger(Slider(3, range=1..5), AtLeast=1, AtMost=1, Maximum=10, Minimum=-2147483648, TreeAccess=False)

radius = GetInteger(Slider(2, range=0..20), AtLeast=1, AtMost=1, Maximum=10, Minimum=-2147483648, TreeAccess=False)

pframes = PerpFrames(Curve=ln, Count=frames, Align=True)  # -> Frames, Parameters
polygon = Polygon(Plane=pframes.Frames, Radius=radius, Segments=segments, FilletRadius=0)  # -> Polygon, Length
dom = ConstructDomain(DomainStart=0, DomainEnd="360")
range = Range(Domain=dom, Steps=frames)
rotate = Rotate(Geometry=graft(polygon.Polygon), Angle=graft(degrees(range)), Plane=PlaneXY(0, 0, 0))  # -> flatten(Geometry), Transform
loft = Loft(Curves=rotate.Geometry, Options={Adjust=False, Closed=False, LoftEnds=0, LoftSimp=0, LoftType=0, Rebuild=10, Refit=0.01})
c_bake = ContextBake(Content=loft)
