# Grasshopper definition HW1-NihanMalkoc.gh (Grasshopper 1.0.8)

number_slider = Slider(4, range=0..10)
level_height = GetInteger(Slider(216, range=100..500), AtLeast=1, AtMost=1, Maximum=2147483647, Minimum=-2147483648, TreeAccess=False)
number_of_levels = GetInteger(number_slider, AtLeast=1, AtMost=1, Maximum=2147483647, Minimum=-2147483648, TreeAccess=False)
base_radius = GetInteger(Slider(500, range=100..500), AtLeast=1, AtMost=1, Maximum=2147483647, Minimum=-2147483648, TreeAccess=False)
series = Series(Start=0, Step=level_height, Count=number_of_levels)
circle = Circle(Plane=PlaneXY(0, 0, 0), Radius=base_radius)
unit_z = UnitZ(Factor=series)
range = Range(Domain=".5 to .8", Steps=expr("x-1", number_slider))
move = Move(Geometry=circle, Motion=unit_z)  # -> Geometry, Transform
graph_mapper = GraphMapper(range, x0=0, x1=1, y0=0, y1=1, Cx=0.4980692565, Cy=0.2335439324, container_name="Conic")
area = Area(Geometry=move.Geometry)  # -> Area, Centroid
scale = Scale(Geometry=move.Geometry, Center=area.Centroid, Factor=graph_mapper)  # -> Geometry, Transform
loft = Loft(Curves=scale.Geometry, Options={Adjust=False, Closed=False, LoftEnds=0, LoftSimp=0, LoftType=0, Rebuild=10, Refit=0.01})
number_of_edges = GetInteger(Slider(8, range=3..20), AtLeast=1, AtMost=1, Maximum=2147483647, Minimum=-2147483648, TreeAccess=False)
mesh_surface = MeshSurface(Surface=loft, UCount=number_of_edges, VCount=number_of_edges, Overhang=True, Equalize=False)
deconstruct_mesh = DeconstructMesh(Mesh=mesh_surface)  # -> Vertices, Faces, Colours, Normals
list_length = ListLength(List=deconstruct_mesh.Faces)
concatenate = Concatenate(Fragment_A="The vertical void has ", Fragment_B=list_length, A=" faces")
mesh = Mesh(mesh_surface)
panel = Panel(concatenate)
context_bake = ContextBake(Geometry=mesh)
context_print = ContextPrint(Faces=concatenate)
