# Grasshopper definition Hala's first assignement.gh (Grasshopper 1.0.8)
# plug-ins: Bifocals

number_slider = Slider(8, range=0..10)
get_number = GetNumber(Slider(6, range=0..10), AtLeast=1, AtMost=1, Maximum=1.797693135e+308, Minimum=-1.797693135e+308, TreeAccess=False)
get_number_2 = GetNumber(Slider(6, range=0..10), AtLeast=1, AtMost=1, Maximum=1.797693135e+308, Minimum=-1.797693135e+308, TreeAccess=False)
get_number_3 = GetNumber(Slider(6, range=0..10), AtLeast=1, AtMost=1, Maximum=1.797693135e+308, Minimum=-1.797693135e+308, TreeAccess=False)
series = Series(Start=0, Step=get_number_2, Count=number_slider)
series_2 = Series(Start=0, Step=get_number_3, Count=number_slider)
series_3 = Series(Start=0, Step=get_number, Count=number_slider)
cross_reference = CrossReference(ListListA=series_3, ListListB=series_2, ListA=series, CrossMode=1)  # -> ListListA, ListListB, ListA
construct_point = ConstructPoint(XCoordinate=cross_reference.ListListA, YCoordinate=cross_reference.ListListB, ZCoordinate=cross_reference.ListA)
get_point = GetPoint(construct_point, AtLeast=1, AtMost=1, Realtime=True, TreeAccess=False)
point = Point(get_point)
point_2 = Point(point)
number_slider_2 = Slider(3, range=0..10)
construct_domain = ConstructDomain(DomainStart=Slider(0.2, range=0..1), DomainEnd=Slider(0.9, range=0..1))
bounds = Bounds(Numbers=point_2)
remap_numbers = RemapNumbers(Value=point_2, Source=bounds, Target=construct_domain)  # -> Mapped, Clipped
center_box = CenterBox(Base=point, X=number_slider_2, Y=number_slider_2, Z=number_slider_2)
get_geometry = GetGeometry(center_box, AnnotationTypeFilter=3966, AtLeast=1, AtMost=1, DeleteInput=False, Filter=1074081855, TreeAccess=False)
graph_mapper = GraphMapper(remap_numbers.Mapped, x0=0, x1=1, y0=0, y1=1, container_name="Sine", Equation_px=[0.830506742, 1], Equation_py=[0, 1])
area = Area(Geometry=get_geometry)  # -> Area, Centroid
scale = Scale(Geometry=get_geometry, Center=area.Centroid, Factor=graph_mapper)  # -> Geometry, Transform
deconstruct_brep = DeconstructBrep(Brep=get_geometry)  # -> Faces, Edges, Vertices
deconstruct_brep_2 = DeconstructBrep(Brep=scale.Geometry)  # -> Faces, Edges, Vertices
context_bake = ContextBake(Content=scale.Geometry)
number_slider_3 = Slider(0.05, range=0..0.1)
custom_preview = CustomPreview(Geometry=scale.Geometry, Material=ColourSwatch(SwatchColor=RGB(171, 157, 157)))
curve = Curve(deconstruct_brep.Edges)
curve_2 = Curve(deconstruct_brep.Edges)
curve_3 = Curve(deconstruct_brep_2.Edges)
merge = Merge(Data1=graft(curve_3), Data2=graft(curve_2))
pipe = Pipe(Curve=deconstruct_brep_2.Edges, Radius=number_slider_3, Caps=0, FitRail=False)
pipe_2 = Pipe(Curve=curve, Radius=number_slider_3, Caps=0, FitRail=False)
loft = Loft(Curves=merge, Options={Adjust=False, Closed=False, LoftEnds=0, LoftSimp=0, LoftType=0, Rebuild=10, Refit=0.01})
deconstruct_brep_3 = DeconstructBrep(Brep=loft)  # -> Faces, Edges, Vertices
pipe_3 = Pipe(Curve=deconstruct_brep_3.Edges, Radius=number_slider_3, Caps=0, FitRail=False)
context_bake_2 = ContextBake(Content=pipe_3)
custom_preview_2 = CustomPreview(Geometry=pipe_3, Material=ColourSwatch(SwatchColor=RGB(18, 18, 18)))
