# Grasshopper definition Hops first doc.gh (Grasshopper 1.0.8)
# plug-ins: Hops

file_path = FilePath("C:\Users\pc\Desktop\Source\bimsc26-datamgmt-session01\SpikeyThing.gh")
panel = Panel("""584
10
26
1987
487""")
panel_2 = Panel(file_path)
hops = Hops(
    _Path=file_path,
    Radius=Slider(4.6, range=0.2..10),
    Count=Slider(46, range=17..100),
    Length=20,
    CacheResultsInMemory=True,
    CacheSolveResults=True,
    RemoteDefinitionLocation="C:\Users\pc\Desktop\Source\bimsc26-datamgmt-session01\SpikeyThing.gh",
    RemoteSolveVersion=(0, 1, 0),
    ShowInput_Enabled=False,
    ShowInput_Path=True,
    SynchronousSolve=True)  # -> Geometry, Faces
file_path_2 = FilePath("C:\Users\pc\Desktop\Source\bimsc26-datamgmt-session01\Simple addition.gh")
hops_2 = Hops(
    _Path=file_path_2,
    A=panel,
    B=Slider(167, range=0..1000),
    CacheResultsInMemory=True,
    CacheSolveResults=True,
    RemoteDefinitionLocation="C:\Users\pc\Desktop\Source\bimsc26-datamgmt-session01\Simple addition.gh",
    RemoteSolveVersion=(0, 1, 0),
    ShowInput_Enabled=False,
    ShowInput_Path=True,
    SynchronousSolve=True)
panel_3 = Panel(hops.Faces)
panel_4 = Panel(hops.Geometry)
panel_5 = Panel(hops_2)
