# Grasshopper definition MAHMOUD MOHAMED.gh (Grasshopper 1.0.8)
# plug-ins: SurfacePlus

r1 = GetInteger(Slider(26, range=0..30), AtLeast=1, AtMost=1, Maximum=2147483647, Minimum=-2147483648, TreeAccess=True)
r2 = GetInteger(Slider(14, range=0..30), AtLeast=1, AtMost=1, Maximum=2147483647, Minimum=-2147483648, TreeAccess=True)
flr_h = GetInteger(Slider(4, range=0..10), AtLeast=1, AtMost=1, Maximum=2147483647, Minimum=-2147483648, TreeAccess=True)
flr_n = GetInteger(Slider(30, range=0..100), AtLeast=1, AtMost=1, Maximum=2147483647, Minimum=-2147483648, TreeAccess=True)
drn = GetInteger(Slider(30, range=0..100), AtLeast=1, AtMost=1, Maximum=2147483647, Minimum=-2147483648, TreeAccess=True)
angle = GetInteger(Slider(6, range=0..10), AtLeast=1, AtMost=1, Maximum=2147483647, Minimum=-2147483648, TreeAccess=True)
u = GetInteger(Slider(17, range=0..30), AtLeast=1, AtMost=1, Maximum=2147483647, Minimum=-2147483648, TreeAccess=False)
v = GetInteger(Slider(30, range=0..30), AtLeast=1, AtMost=1, Maximum=2147483647, Minimum=-2147483648, TreeAccess=False)
ellipse = Ellipse(Plane=PlaneXY(0, 0, 0), Radius1=r1, Radius2=r2)  # -> Ellipse, Focus1, Focus2
series = Series(Start=0, Step=angle, Count=drn)
series_2 = Series(Start=0, Step=flr_h, Count=flr_n)
Z = UnitZ(Factor=series_2)
rotate = Rotate(Geometry=ellipse.Ellipse, Angle=degrees(series), Plane=PlaneXY(0, 0, 0))  # -> Geometry, Transform
move = Move(Geometry=rotate.Geometry, Motion=Z)  # -> Geometry, Transform
loft = Loft(Curves=move.Geometry, Options={Adjust=False, Closed=False, LoftEnds=0, LoftSimp=0, LoftType=0, Rebuild=10, Refit=0.01})
tri_dia = DiamondTriangleSurfaces(Surface=loft, Direction=0, UDivisions=u, VDivisions=v, Flip=False, Edges=0)  # -> Surface, UVPolylines
c_bake = ContextBake(Content=tri_dia.Surface)
