# Grasshopper definition M_Osmolovska_Shell.gh (Grasshopper 1.0.8)

b_min = Slider(3.73, range=0..5)
b_max = Slider(1.33, range=0..10)

a_min = Slider(10, range=0..10)
a_max = Slider(12.8, range=0..15)

number_slider = Slider(50, range=1..50)

py3 = Python3Script(
    a_min=a_min,
    a_max=a_max,
    b_min=b_min,
    b_max=b_max,
    i_count=number_slider,
    j_count=Slider(42, range=1..50),
    Rotation_factor=Slider(5.5, range=1..10))  # -> out, surface, flat_points; inputs a_min: Double, a_max: Double, b_min: Double, b_max: Double, i_count: Int32, j_count: Int32, Rotation_factor: Double
# ---------- py3: Python ----------
# requirements: numpy

import Rhino.Geometry as rg
import math
import numpy as np 


#define math functions
pi = math.pi
sin = math.sin
cos = math.cos
log = math.log
tan = math.tan

# i_step = 0.1
# j_step = 0.1

# Define the ranges for i and j

#i_range = [i * i_step for i in range(int(4 * pi / i_step) + 1)]
#j_range = [j * j_step for j in range(int(2 * pi / j_step) + 1)]

# i_range = np.arange(0, 4 * pi, i_step)
# j_range = np.arange(0, 2, j_step)

i_range = np.linspace(0, Rotation_factor * pi, i_count)
j_range = np.linspace(0, 2, j_count + 1)
# print(j_range)
j_range = j_range[1:]
# print(j_range)
a_range = np.linspace(a_min, a_max, i_count)
b_range = np.linspace(b_min, b_max, i_count)

print(i_range)
print(a_range)
print(b_range)
print(j_range)

# Initialize lists to store points
points = []

#a = 1
#b = 0.2

# Calculate the equations
for i, a, b in zip(i_range , a_range, b_range):
    row =[]
    for j in j_range:
        # Calculate x y z
        x = a * cos(i) * sin(j)
        y = a * sin(i) * sin(j)
        z = a * (cos(j) + log(tan(j/2))) + b * i
    
        
        print(f"i={i}, j={j}, a={a} \n(x:{x}, y:{y}, z:{z})\n")
        
        # Create a point based on x, y, z
        point = rg.Point3d(x, y, z)
        row.append(point)
    points.append(row)

flat_points = [pt for row in points for pt in row]

# Create a surface from points
surface = rg.NurbsSurface.CreateFromPoints(flat_points, len(i_range), len(j_range), 3,3)
# ---------- end py3 ----------
surface_from_points = SurfaceFromPoints(Points=py3.flat_points, UCount=number_slider, Interpolate=False)
data = Data(py3.surface)
preview = CustomPreview(Geometry=data, Material=ColourSwatch(SwatchColor=RGBA(168, 134, 49, 202)))
cloud = CloudDisplay(Points=py3.flat_points, Colours=ColourSwatch(SwatchColor=RGB(0, 0, 0)), Size=Slider(0.091, range=0.001..1), SpriteType=1)

# ---- group: HEIGHT
b = Slider(0.13, range=0.01..10)

# ---- group: SCALE FACTOR
a = Slider(1.3, range=0.1..10)

# ----
scale_factor = GetNumber(a, AtLeast=1, AtMost=1, Maximum=1.797693135e+308, Minimum=-1.797693135e+308, TreeAccess=True)
height = GetNumber(b, AtLeast=0, AtMost=10, Maximum=1.797693135e+308, Minimum=-1.797693135e+308, TreeAccess=True)
j_count = GetInteger(Slider(10, range=1..50), AtLeast=1, AtMost=1, Maximum=2147483647, Minimum=-2147483648, TreeAccess=False)
i_count = GetInteger(Slider(13, range=1..50), AtLeast=1, AtMost=1, Maximum=2147483647, Minimum=-2147483648, TreeAccess=False)
py3_2 = Python3Script(a=scale_factor, b=height, i_count=i_count, j_count=j_count)  # -> out, surface, flat_points; inputs a: Double, b: Double, i_step: Double, j_step: Double, i_count: Int32, j_count: Int32
# ---------- py3_2: Python ----------
# requirements: numpy

import Rhino.Geometry as rg
import math
import numpy as np 


#define math functions
pi = math.pi
sin = math.sin
cos = math.cos
log = math.log
tan = math.tan

# i_step = 0.1
# j_step = 0.1

# Define the ranges for i and j

#i_range = [i * i_step for i in range(int(4 * pi / i_step) + 1)]
#j_range = [j * j_step for j in range(int(2 * pi / j_step) + 1)]

# i_range = np.arange(0, 4 * pi, i_step)
# j_range = np.arange(0, 2, j_step)

i_range = np.linspace(0, 4 * pi, i_count)
j_range = np.linspace(0, 2, j_count + 1)
print(j_range)
j_range = j_range[1:]
print(j_range)

print(i_range)
print(j_range)

# Initialize lists to store points
points = []

#a = 1
#b = 0.2

# Calculate the equations
for i in i_range:
    row =[]
    for j in j_range:
        # Calculate Π, Θ, and K
        x = a * cos(i) * sin(j)
        y = a * sin(i) * sin(j)
        z = a * (cos(j) + log(tan(j/2))) + b * i
    
        
        print(f"i={i}, j={j}, \n(x:{x}, y:{y}, z:{z})\n")
        
        # Create a point based on x, y, z
        point = rg.Point3d(x, y, z)
        row.append(point)
    points.append(row)

flat_points = [pt for row in points for pt in row]

# Create a surface from points
surface = rg.NurbsSurface.CreateFromPoints(flat_points, len(i_range), len(j_range), 3,3)
a = surface
# ---------- end py3_2 ----------
data_2 = Data(py3_2.surface)
context_bake = ContextBake(Content=py3_2.surface)
preview_2 = CustomPreview(Geometry=data_2, Material=ColourSwatch(SwatchColor=RGBA(173, 126, 7, 202)))
cloud_2 = CloudDisplay(Points=py3_2.flat_points, Colours=ColourSwatch(SwatchColor=RGB(0, 0, 0)), Size=Slider(0.016, range=0..1), SpriteType=1)
