# Grasshopper definition Marina_Osmolovska_1_Homework_Hops.gh (Grasshopper 1.0.8)
# plug-ins: Hops

number_slider = Slider(107, range=1..200)  # disabled
number_slider_2 = Slider(4, range=1..10)  # disabled
file_path = FilePath("D:\Marina\MaCAD 2025\source\macad26\bimsc26-datamgmt-session01\M_Osmolovska_Shell.gh")
a = GetInteger(number_slider_2, AtLeast=2, AtMost=1, Maximum=2147483647, Minimum=-2147483648, TreeAccess=True)  # disabled
b = GetNumber(number_slider, AtLeast=1, AtMost=1, Maximum=1.797693135e+308, Minimum=-1.797693135e+308, TreeAccess=False)  # disabled
mass_addition = MassAddition(Input=a)  # -> Result, PartialResults; disabled
hops = Hops(
    _Path=file_path,
    ScaleFactor=Slider(1, range=1..3),
    Height=Slider(0.17, range=0..1),
    ICount=13,
    JCount=10,
    CacheResultsInMemory=True,
    CacheSolveResults=True,
    RemoteDefinitionLocation="D:\Marina\MaCAD 2025\source\macad26\bimsc26-datamgmt-session01\M_Osmolovska_Shell.gh",
    RemoteSolveVersion=(0, 1, 0),
    ShowInput_Enabled=False,
    ShowInput_Path=True,
    SynchronousSolve=True)
geometry = Geometry(hops)
addition = Addition(A=mass_addition.Result, B=b)  # disabled
panel = Panel(addition)  # disabled
