# Grasshopper definition Panelization_Start.gh (Grasshopper 1.0.8)
# plug-ins: Hops

number_of_panels = Slider(6, range=0..100)
panel_thickness = Slider(0.5, range=0..10)
u_panels = Slider(5, range=0..20)
v_panels = Slider(2, range=0..20)
frequency = Slider(3, range=0..10)
panel_depth = Slider(4, range=0..100)
panel_rotation = Slider(0, range=0..180)
amplitude = Slider(5, range=0..10)
roof_extents = Slider(70, range=0..100)

file_path = FilePath("G:\INTEGRATED-PROJECTS\Softwares-3\bimsc26-datamgmt-session01\panelization.gh")
panel = Panel(file_path)
hops = Hops(
    _Path=file_path,
    RoofExtents=roof_extents,
    NumberOfPanels=number_of_panels,
    PanelThickness=panel_thickness,
    PanelDepth=panel_depth,
    PanelRotation=panel_rotation,
    UPanels=u_panels,
    VPanels=v_panels,
    Frequency=frequency,
    Amplitude=amplitude,
    Line=[Line((-58.61181279, -6.511903091, 29.86225644), (-59.02828588, -29.85133158, 14.17251368)), Line((-58.61181279, -6.511903091, 29.86225644), (-59.02828588, 16.8275254, 14.17251368))],
    CacheResultsInMemory=True,
    CacheSolveResults=True,
    RemoteDefinitionLocation="G:\INTEGRATED-PROJECTS\Softwares-3\bimsc26-datamgmt-session01\panelization.gh",
    RemoteSolveVersion=(0, 1, 0),
    ShowInput_Enabled=False,
    ShowInput_Path=True,
    SynchronousSolve=True)
panel_2 = Panel(hops)
