# Grasshopper definition RaniaChihaoui_HomeworkS01_GhDefinition.gh (Grasshopper 1.0.8)
# Spherical spikey thing

# Rania Chihaoui
# MACad 2025/2026
# CBDM Seminar
# Session 01
# Homework 01
# Wavy Things
curve = Curve([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])

# ----
# Default values
displacement_of_waves_y = Slider(4, range=0..10)
amount_of_waves_per_segment = Slider(192, range=0..1000)
thicknes_of_waves = Slider(0.2, range=0..10)
amount_of_z_waves = Slider(30, range=0..100)
loft = Loft(Curves=curve, Options={Adjust=False, Closed=False, LoftEnds=0, LoftSimp=0, LoftType=0, Rebuild=10, Refit=0.01})

# ----
# Inputs
amount_of_z_waves_2 = GetInteger(amount_of_z_waves, AtLeast=1, AtMost=1, Maximum=2147483647, Minimum=-2147483648, TreeAccess=False)
displacement_of_waves_y_2 = GetInteger(displacement_of_waves_y, AtLeast=1, AtMost=1, Maximum=2147483647, Minimum=-2147483648, TreeAccess=False)
amount_of_waves_per_segment_2 = GetNumber(amount_of_waves_per_segment, AtLeast=1, AtMost=1, Maximum=1.797693135e+308, Minimum=-1.797693135e+308, TreeAccess=False)
thickness_of_waves = GetNumber(thicknes_of_waves, AtLeast=1, AtMost=1, Maximum=1.797693135e+308, Minimum=-1.797693135e+308, TreeAccess=False)
surface = GetGeometry(loft, AnnotationTypeFilter=3966, AtLeast=1, AtMost=1, DeleteInput=False, Filter=1074081855, TreeAccess=False)

series = Series(Start="1", Step=thickness_of_waves, Count=displacement_of_waves_y_2)
divide_surface = DivideSurface(Surface=surface, UCount=amount_of_z_waves_2, VCount=amount_of_waves_per_segment_2)  # -> Points, Normals, Parameters
flip_matrix = FlipMatrix(Data=divide_surface.Points)
flip_matrix_2 = FlipMatrix(Data=divide_surface.Normals)
flip_matrix_3 = FlipMatrix(Data=divide_surface.Parameters)
cull_index = CullIndex(List=reverse(series), Indices="0", Wrap=True)
cull_index_2 = CullIndex(List=series, Indices="0", Wrap=True)
merge = Merge(Data1=flatten(cull_index_2), Data2=flatten(cull_index))  # -> flatten(Result)
shift_list = ShiftList(List=merge, Shift=expr("x-1", displacement_of_waves_y_2), Wrap=True)  # -> flatten(List)
repeat_data = RepeatData(Data=merge, Length=expr("x+1", amount_of_z_waves_2))
panel = Panel(shift_list)
repeat_data_2 = RepeatData(Data=shift_list, Length=expr("x+1", amount_of_z_waves_2))
data = Data(repeat_data)
data_2 = Data(repeat_data_2)
entwine = Entwine(Branch00=data, Branch01=data_2, FlattenInputs=True)
tree_statistics = TreeStatistics(Tree=entwine)  # -> Paths, Length, Count
repeat_data_3 = RepeatData(Data=tree_statistics.Paths, Length=expr("x+1", amount_of_waves_per_segment_2))
branch = TreeBranch(Tree=entwine, Path=repeat_data_3, MaintainPaths=False)
amplitude = Amplitude(Vector=flip_matrix_2, Amplitude=expr("-x", branch))
move = Move(Geometry=flip_matrix, Motion=amplitude)  # -> Geometry, Transform
repeat_data_4 = RepeatData(Data="true", Length="3")  # -> flatten(Data)
repeat_data_5 = RepeatData(Data="false", Length="3")  # -> flatten(Data)
polyline = PolyLine(Vertices=move.Geometry, Closed=False)
merge_2 = Merge(Data1=repeat_data_4, Data2=repeat_data_5)
dispatch = Dispatch(List=flatten(polyline), DispatchPattern=merge_2)  # -> ListA, ListB
geometry = Geometry(dispatch.ListB)
partition_list = PartitionList(List=geometry, Size="3")
list_item = ListItem(List=partition_list, Index="1", Wrap=True)
list_item_2 = ListItem(List=partition_list, Index="0", Wrap=True)
list_item_3 = ListItem(List=partition_list, Index="2", Wrap=True)
ruled_surface = RuledSurface(CurveA=list_item_2, CurveB=list_item)
ruled_surface_2 = RuledSurface(CurveA=list_item, CurveB=list_item_3)
geometry_2 = Geometry([ruled_surface_2, ruled_surface])
flatten_tree = FlattenTree(Tree=ruled_surface_2, Path="{0}")
list_length = ListLength(List=flatten_tree)
concatenate = Concatenate(Fragment_A="The Geometry has ", Fragment_B=list_length, A=" wavy things")
panel_2 = Panel(concatenate)

# ----
# Outputs
context_bake = ContextBake(Geometry=geometry_2)
context_print = ContextPrint(Text=concatenate)
