# Grasshopper definition RaniaChihaoui_HomeworkS01_HopsFunction.gh (Grasshopper 1.0.8)
# plug-ins: Hops
# Spherical spikey thing

# Rania Chihaoui
# MACad 2025/2026
# CBDM Seminar
# Session 01
# Homework 01
# Wavy Things
file_path = FilePath("C:\Users\Win11\Documents\GitHub\bimsc26-datamgmt-session01\RaniaChihaoui_HomeworkS01_GhDefinition.gh")

amount_of_waves_per_segment = Slider(192, range=0..1000)
displacement_of_waves_y = Slider(4, range=0..10)
amount_of_z_waves = Slider(30, range=0..100)
thicknes_of_waves = Slider(0.2, range=0..10)
# Default Inputs
curve = Curve([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])
loft = Loft(Curves=curve, Options={Adjust=False, Closed=False, LoftEnds=0, LoftSimp=0, LoftType=0, Rebuild=10, Refit=0.01})

# ----
# Function
hops = Hops(
    _Path=file_path,
    Surface=loft,
    AmountOfZWaves=amount_of_z_waves,
    AmountOfWavesPerSegment=amount_of_waves_per_segment,
    ThicknessOfWaves=thicknes_of_waves,
    DisplacementOfWavesY=displacement_of_waves_y,
    CacheResultsInMemory=True,
    CacheSolveResults=True,
    RemoteDefinitionLocation="C:\Users\Win11\Documents\GitHub\bimsc26-datamgmt-session01\RaniaChihaoui_HomeworkS01_GhDefinition.gh",
    RemoteSolveVersion=(0, 1, 0),
    ShowInput_Enabled=False,
    ShowInput_Path=True,
    SynchronousSolve=True)  # -> Geometry, Text

panel = Panel(hops.Text)
# Output
geometry = Geometry(hops.Geometry)
