# Grasshopper definition Shuai Zhang_gh definition_11.gh (Grasshopper 1.0.8)

number_slider = Slider(3.34, range=0..10)
radius = GetNumber(
    Slider(7, range=0..10),
    AtLeast=1,
    AtMost=1,
    Maximum=1.797693135e+308,
    Minimum=-1.797693135e+308,
    Prompt="Radius of the base polygon size",
    TreeAccess=False)
count = GetInteger(
    Slider(2.42, range=0..10),
    AtLeast=1,
    AtMost=1,
    Maximum=2147483647,
    Minimum=-2147483648,
    Prompt="Number of steps the stirrup",
    TreeAccess=False)
length = GetNumber(
    Slider(32, range=0..100),
    AtLeast=1,
    AtMost=1,
    Maximum=1.797693135e+308,
    Minimum=-1.797693135e+308,
    Prompt="Length of the stirrup",
    TreeAccess=False)
rotation = GetNumber(
    Slider(32, range=0..100),
    AtLeast=1,
    AtMost=1,
    Maximum=1.797693135e+308,
    Minimum=-1.797693135e+308,
    Prompt="number of rotation",
    TreeAccess=False)
scale = GetNumber(
    Slider(32, range=0..100),
    AtLeast=1,
    AtMost=1,
    Maximum=1.797693135e+308,
    Minimum=-1.797693135e+308,
    Prompt="number of scale",
    TreeAccess=False)
extention = GetNumber(
    number_slider,
    AtLeast=1,
    AtMost=1,
    Maximum=1.797693135e+308,
    Minimum=-1.797693135e+308,
    Prompt="extention of the stirrup",
    TreeAccess=False)

# ----
# basic shape
xz = XZPlane(Origin=Point(0, 0, 0))
series = Series(Start=0, Step=count, Count=length)
polygon = Polygon(Plane=xz, Radius=radius, Segments=6, FilletRadius=0)  # -> Polygon, Length
angel_degree = Slider(15, range=0..20)
Y = UnitY(Factor=series)
move = Move(Geometry=polygon.Polygon, Motion=Y)  # -> Geometry, Transform
area = Area(Geometry=move.Geometry)  # -> Area, Centroid
series_2 = Series(Start=0, Step=angel_degree, Count=rotation)
range = Range(Domain="0 to 1", Steps=expr("x-1", scale))
rotate = Rotate(Geometry=move.Geometry, Angle=degrees(series_2), Plane=area.Centroid)  # -> Geometry, Transform
graph = GraphMapper(
    range,
    x0=0,
    x1=1,
    y0=0,
    y1=1,
    container_name="Bezier",
    cpx=[0, 0.3625784814, 0.4949151278, 1],
    cpy=[0.2664348483, 0.2975280285, 1, 0.7983767986])
area_2 = Area(Geometry=move.Geometry)  # -> Area, Centroid
multiplication = Multiplication(A=graph, B=Slider(3, range=0..10))
scale_2 = Scale(Geometry=rotate.Geometry, Center=area_2.Centroid, Factor=multiplication)  # -> Geometry, Transform

disc = Discontinuity(Curve=scale_2.Geometry, Level=1)  # -> Points, Parameters
explode = Explode(Curve=scale_2.Geometry, Recursive=False)  # -> Segments, Vertices
rebuild_curve = RebuildCurve(Curve=explode.Segments, Count=10, Tangents=False)
divide = DivideCurve(Curve=scale_2.Geometry, Count=Slider(30, range=0..100), Kinks=False)  # -> simplify(Points), Tangents, Parameters
flip = FlipMatrix(Data=divide.Points)
ext = ExtendCurve(Curve=rebuild_curve, Type=0, Start=extention, End=number_slider)
interpolate = Interpolate(Vertices=flip, Degree=3, Periodic=False, KnotStyle=1)  # -> flatten(Curve), Length, Domain
loft = Loft(Curves=ext, Options={Adjust=False, Closed=False, LoftEnds=0, LoftSimp=0, LoftType=0, Rebuild=10, Refit=0.01})  # -> flatten(Loft)
pipe = Pipe(Curve=interpolate.Curve, Radius=Slider(0.2, range=0..4), Caps=0, FitRail=False)
mesh_join = MeshJoin(Meshes=loft)
mesh_colours = MeshColours(Mesh=pipe, Colours=ColourSwatch(SwatchColor=RGB(125, 125, 125)))
weld_mesh = WeldMesh(Mesh=mesh_join, Angle=3.141592654)
mesh_join_2 = MeshJoin(Meshes=[mesh_colours, weld_mesh])

# ----
# Outputs
context_bake = ContextBake(Geometry=mesh_join_2)
