# Grasshopper definition Shuai Zhang_gh definition_3.gh (Grasshopper 1.0.8)

radius = GetNumber(
    Slider(7, range=0..10),
    AtLeast=1,
    AtMost=1,
    Maximum=1.797693135e+308,
    Minimum=-1.797693135e+308,
    Prompt="Radius of the base polygon size",
    TreeAccess=False)
count = GetInteger(
    Slider(2.42, range=0..10),
    AtLeast=1,
    AtMost=1,
    Maximum=2147483647,
    Minimum=-2147483648,
    Prompt="Number of steps the stirrup",
    TreeAccess=False)
length = GetNumber(
    Slider(32, range=0..100),
    AtLeast=1,
    AtMost=1,
    Maximum=1.797693135e+308,
    Minimum=-1.797693135e+308,
    Prompt="Length of the stirrup",
    TreeAccess=False)
rotation = GetNumber(
    Slider(32, range=0..100),
    AtLeast=1,
    AtMost=1,
    Maximum=1.797693135e+308,
    Minimum=-1.797693135e+308,
    Prompt="number of rotation",
    TreeAccess=False)
scale = GetNumber(
    Slider(32, range=0..100),
    AtLeast=1,
    AtMost=1,
    Maximum=1.797693135e+308,
    Minimum=-1.797693135e+308,
    Prompt="number of scale",
    TreeAccess=False)

# ----
# basic shape
xz = XZPlane(Origin=Point(0, 0, 0))
series = Series(Start=0, Step=count, Count=length)
polygon = Polygon(Plane=xz, Radius=radius, Segments=6, FilletRadius=0)  # -> Polygon, Length
angel_degree = Slider(15, range=0..20)
Y = UnitY(Factor=series)
move = Move(Geometry=polygon.Polygon, Motion=Y)  # -> Geometry, Transform
area = Area(Geometry=move.Geometry)  # -> Area, Centroid
series_2 = Series(Start=0, Step=angel_degree, Count=rotation)
range = Range(Domain="0 to 1", Steps=expr("x-1", scale))
rotate = Rotate(Geometry=move.Geometry, Angle=degrees(series_2), Plane=area.Centroid)  # -> Geometry, Transform
graph = GraphMapper(
    range,
    x0=0,
    x1=1,
    y0=0,
    y1=1,
    container_name="Bezier",
    cpx=[0, 0.3625784814, 0.4949151278, 1],
    cpy=[0.2664348483, 0.2975280285, 1, 0.7983767986])
area_2 = Area(Geometry=move.Geometry)  # -> Area, Centroid
multiplication = Multiplication(A=graph, B=Slider(3, range=0..10))
scale_2 = Scale(Geometry=rotate.Geometry, Center=area_2.Centroid, Factor=multiplication)  # -> Geometry, Transform

disc = Discontinuity(Curve=scale_2.Geometry, Level=1)  # -> Points, Parameters
number_slider = Slider(3.34, range=0..10)
divide = DivideCurve(Curve=scale_2.Geometry, Count=Slider(60, range=0..100), Kinks=False)  # -> simplify(Points), Tangents, Parameters
shatter = Shatter(Curve=scale_2.Geometry, Parameters=disc.Parameters)  # -> simplify(Segments)
flip = FlipMatrix(Data=divide.Points)
ext = ExtendCurve(Curve=shatter, Type=0, Start=number_slider, End=number_slider)
number_slider_2 = Slider(0.1, range=0..0.1)
intcrv = Interpolate(Vertices=flip, Degree=3, Periodic=False, KnotStyle=1)  # -> flatten(Curve), Length, Domain
custom_preview = CustomPreview(
    Geometry=intcrv.Curve,
    Material={diffuse=RGB(114, 114, 120), emission=RGB(34, 34, 36), shine=0.5, specular=RGB(255, 255, 255), transparency=0})
