# Grasshopper definition Shuai Zhang_gh definition_5.gh (Grasshopper 1.0.8)

number_slider = Slider(3, range=0..10)

# ----
# Inputs
radius = GetNumber(
    Slider(7, range=0..10),
    AtLeast=1,
    AtMost=1,
    Maximum=1.797693135e+308,
    Minimum=0.2,
    Prompt="Radius of the base sphere on which the spikes grow",
    TreeAccess=False)
count = GetInteger(
    Slider(32, range=0..100),
    AtLeast=1,
    AtMost=1,
    Maximum=2147483647,
    Minimum=16,
    Prompt="Number of spikes growing out of the sphere",
    TreeAccess=False)
length = GetNumber(
    Slider(2.42, range=0..10),
    AtLeast=1,
    AtMost=1,
    Maximum=1.797693135e+308,
    Minimum=-1.797693135e+308,
    Prompt="Length of each spike on the sphere",
    TreeAccess=False)

scale = GetNumber(
    number_slider,
    AtLeast=1,
    AtMost=1,
    Maximum=1.797693135e+308,
    Minimum=0.2,
    Prompt="scale of the base sphere on which the spikes grow",
    TreeAccess=False)

# ----
# basic shape
xz = XZPlane(Origin=Point(0, 0, 0))
series = Series(Start=0, Step=length, Count=count)
polygon = Polygon(Plane=xz, Radius=radius, Segments=6, FilletRadius=0)  # -> Polygon, Length
angel_degree = Slider(15, range=0..20)
Y = UnitY(Factor=series)
move = Move(Geometry=polygon.Polygon, Motion=Y)  # -> Geometry, Transform
area = Area(Geometry=move.Geometry)  # -> Area, Centroid
series_2 = Series(Start=0, Step=angel_degree, Count=count)
range = Range(Domain="0 to 1", Steps=expr("x-1", count))
rotate = Rotate(Geometry=move.Geometry, Angle=degrees(series_2), Plane=area.Centroid)  # -> Geometry, Transform
graph = GraphMapper(
    range,
    x0=0,
    x1=1,
    y0=0,
    y1=1,
    container_name="Bezier",
    cpx=[0, 0.3625784814, 0.4949151278, 1],
    cpy=[0.2664348483, 0.2975280285, 1, 0.7983767986])
area_2 = Area(Geometry=move.Geometry)  # -> Area, Centroid
multiplication = Multiplication(A=graph, B=number_slider)
scale_2 = Scale(Geometry=rotate.Geometry, Center=area_2.Centroid, Factor=multiplication)  # -> Geometry, Transform
