# Grasshopper definition Simple addition.gh (Grasshopper 1.0.8)
# plug-ins: Bifocals

panel = Panel("""584
10
26
1987
487""")
a = GetInteger(panel, AtLeast=1, AtMost=1, Maximum=2147483647, Minimum=-2147483648, TreeAccess=False)
b = GetNumber(Slider(198, range=1..1007), AtLeast=1, AtMost=1, Maximum=1.797693135e+308, Minimum=-1.797693135e+308, TreeAccess=False)
mass_addition = MassAddition(Input=a)  # -> Result, PartialResults
addition = Addition(A=mass_addition.Result, B=b)
context_print = ContextPrint(Text=addition)
panel_2 = Panel(addition)
