# Grasshopper definition SpikeyThing_ETM.gh (Grasshopper 1.0.8)
# plug-ins: Hops

file_path = FilePath("C:\Users\etmaglari\IAAC\bimsc26-datamgmt-session01\SpikeyThing.gh")
file_path_2 = FilePath("C:\Users\etmaglari\IAAC\bimsc26-datamgmt-session01\add.gh")
panel = Panel(file_path)
panel_2 = Panel(file_path_2)
hops = Hops(
    _Path=file_path,
    Radius=5,
    Count=16,
    Length=20,
    CacheResultsInMemory=True,
    CacheSolveResults=True,
    RemoteDefinitionLocation="C:\Users\etmaglari\IAAC\bimsc26-datamgmt-session01\SpikeyThing.gh",
    RemoteSolveVersion=(0, 1, 0),
    ShowInput_Enabled=False,
    ShowInput_Path=True,
    SynchronousSolve=True)  # -> Geometry, Faces
hops_2 = Hops(
    _Path=file_path_2,
    A=Slider(21, range=1..100),
    B=Slider(16, range=1..100),
    CacheResultsInMemory=True,
    CacheSolveResults=True,
    RemoteDefinitionLocation="C:\Users\etmaglari\IAAC\bimsc26-datamgmt-session01\add.gh",
    RemoteSolveVersion=(0, 1, 0),
    ShowInput_Enabled=False,
    ShowInput_Path=True,
    SynchronousSolve=True)
panel_3 = Panel(hops_2)
