# Grasshopper definition W1_MariaSanchez.gh (Grasshopper 1.0.8)

prismradius = GetNumber(
    Slider(1, range=1..5),
    AtLeast=1,
    AtMost=1,
    Maximum=1.797693135e+308,
    Minimum=-1.797693135e+308,
    Prompt="Radius for the base prism curve?",
    TreeAccess=False)
segmentnr = GetInteger(
    Slider(3, range=3..10),
    AtLeast=1,
    AtMost=1,
    Maximum=2147483647,
    Minimum=-2147483648,
    Prompt="Number of sides/segments of the prism?",
    TreeAccess=False)
prismheight = GetNumber(
    Slider(5, range=5..20),
    AtLeast=1,
    AtMost=1,
    Maximum=1.797693135e+308,
    Minimum=-1.797693135e+308,
    Prompt="Height of the prism?",
    TreeAccess=False)
twistangle = GetInteger(Slider(126, range=0..180), AtLeast=1, AtMost=1, Maximum=2147483647, Minimum=-2147483648, TreeAccess=False)

polygon = Polygon(Plane=PlaneXY(0, 0, 0), Radius=prismradius, Segments=segmentnr, FilletRadius=0)  # -> Polygon, Length
area = Area(Geometry=polygon.Polygon)  # -> Area, Centroid
unit_z = UnitZ(Factor=prismheight)
extrude = Extrude(Base=polygon.Polygon, Direction=unit_z)
line_sdl = LineSDL(Start=area.Centroid, Direction=unit_z, Length=prismheight)
radians = Radians(Degrees=twistangle)
cap_holes = CapHoles(Brep=extrude)
twist = Twist(Geometry=cap_holes, Axis=line_sdl, Angle=radians, Infinite=False, Rigid=False)

context_bake = ContextBake(Content=twist)
