# Grasshopper definition W1_MariaSanchez_Hops.gh (Grasshopper 1.0.8)
# plug-ins: Hops

prismradius = Slider(2.5, range=1..5)
segmentnr = Slider(8, range=3..10)
prismheight = Slider(12.6, range=5..20)
twistangle = Slider(146, range=0..180)
file_path = FilePath("C:\Users\maria\Documents\GitHub\bimsc26-datamgmt-session01\W1_MariaSanchez.gh")
hops = Hops(
    _Path=file_path,
    PrismRadius=prismradius,
    SegmentNr=segmentnr,
    PrismHeight=prismheight,
    TwistAngle=twistangle,
    CacheResultsInMemory=True,
    CacheSolveResults=True,
    RemoteDefinitionLocation="C:\Users\maria\Documents\GitHub\bimsc26-datamgmt-session01\W1_MariaSanchez.gh",
    RemoteSolveVersion=(0, 1, 0),
    ShowInput_Enabled=False,
    ShowInput_Path=True,
    SynchronousSolve=True)
brep = Brep(hops)
