# Grasshopper definition add.gh (Grasshopper 1.0.8)

number_slider = Slider(1, range=1..200)
panel = Panel("""15
5
10
1""")
a = GetInteger(panel, AtLeast=1, AtMost=1, Maximum=2147483647, Minimum=-2147483648, Prompt="first addition input", TreeAccess=True)
b = GetNumber(Slider(17, range=1..200), AtLeast=1, AtMost=1, Maximum=1.797693135e+308, Minimum=-1.797693135e+308, TreeAccess=False)
mass_addition = MassAddition(Input=a)  # -> Result, PartialResults
addition = Addition(A=mass_addition.Result, B=b)
panel_2 = Panel(addition)
result = ContextPrint(Text=addition)
