# Grasshopper definition bamb_u.gh (Grasshopper 1.0.8)
# plug-ins: Pufferfish

subdivisions = Slider(4, range=3..5)
diameter = Slider(4.5, range=3..6)
height = Slider(3.5, range=2..5)
count = Slider(3, range=2..7)
offset = Slider(0.2, range=0..0.5)
subdivision = GetInteger(
    subdivisions,
    AtLeast=1,
    AtMost=1,
    Maximum=2147483647,
    Minimum=-2147483648,
    Prompt="Number of vertical subdivision",
    TreeAccess=False)
diameter_2 = GetNumber(
    diameter,
    AtLeast=1,
    AtMost=1,
    Maximum=1.797693135e+308,
    Minimum=-1.797693135e+308,
    Prompt="Upper Diameter",
    TreeAccess=False)
height_2 = GetNumber(
    height,
    AtLeast=1,
    AtMost=1,
    Maximum=1.797693135e+308,
    Minimum=-1.797693135e+308,
    Prompt="Total Height",
    TreeAccess=False)
count_2 = GetInteger(count, AtLeast=1, AtMost=1, Maximum=2147483647, Minimum=-2147483648, Prompt="Total Trees Count", TreeAccess=False)
offset_2 = GetNumber(
    offset,
    AtLeast=1,
    AtMost=1,
    Maximum=1.797693135e+308,
    Minimum=-1.797693135e+308,
    Prompt="Offset between Trees",
    TreeAccess=False)

subdivision_2 = Number(subdivision)
series = Series(Start=0, Step=1, Count=expr("x+1", subdivision_2))
division = Division(A=series, B=subdivision_2)
basediameter = Panel("0.8")
diameter_3 = Number(diameter_2)
graph_mapper = GraphMapper(division, x0=0, x1=1, y0=0, y1=1, Cx=0.5875308514, Cy=0.1760832667, container_name="Conic")
construct_domain = ConstructDomain(DomainStart=basediameter, DomainEnd=diameter_3)
height_3 = Number(height_2)
multiplication = Multiplication(A=division, B=height_3)
remap_numbers = RemapNumbers(Value=graph_mapper, Source=Domain(0, 1), Target=construct_domain)  # -> Mapped, Clipped
unit_z = UnitZ(Factor=multiplication)
circle = Circle(Plane=PlaneXY(0, 0, 0), Radius=expr("x/2", remap_numbers.Mapped))
move = Move(Geometry=circle, Motion=unit_z)  # -> Geometry, Transform
circles = Geometry(move.Geometry)

diameter_4 = Number(diameter_2)
expression = Expression(r=diameter_4, n="6", Expression="r*tan(π/n)/sin(π/n)")
polygon = Polygon(Plane=PlaneXY(0, 0, 0), Radius=expr("x/2", expression), Segments="6", FilletRadius=0)  # -> Polygon, Length
polygon_2 = Polygon(Plane=PlaneXY(0, 0, 0), Radius=expr("x/2", diameter_4), Segments="6", FilletRadius=0)  # -> Polygon, Length
list_item = ListItem(List=multiplication, Index=0, Wrap=True)  # -> Item1, Item
offset_3 = Number(offset_2)
offset_curve = OffsetCurve(Curve=polygon.Polygon, Distance=offset_3, Corners=1)
explode = Explode(Curve=offset_curve, Recursive=True)  # -> Segments, Vertices
explode_2 = Explode(Curve=polygon_2.Polygon, Recursive=True)  # -> Segments, Vertices
line = Line(StartPoint=explode.Vertices, EndPoint=explode_2.Vertices)
end_points = EndPoints(Curve=explode.Segments)  # -> Start, End
unit_z_2 = UnitZ(Factor=1)
unit_z_3 = UnitZ(Factor=list_item.Item1)
construct_plane = ConstructPlane(Origin=end_points.Start, XAxis=explode.Segments, YAxis=unit_z_2)
move_2 = Move(Geometry=offset_curve, Motion=unit_z_3)  # -> Geometry, Transform
move_3 = Move(Geometry=line, Motion=unit_z_3)  # -> Geometry, Transform
merge = Merge(Data1=move_2.Geometry, Data2=move_3.Geometry)
pipe = Pipe(Curve=merge, Radius=0.015, Caps=0, FitRail=False)
hexculms = Geometry(pipe)

diameter_5 = Number(diameter_2)
multiplication_2 = Multiplication(A=diameter_5, B="4")
round = Round(Number=multiplication_2)  # -> Nearest, Floor, Ceiling
circles_2 = Geometry(circles)
subdivision_3 = Number(subdivision)
series_2 = Series(Start=0, Step=1, Count=expr("x+1", subdivision_3))
divide_curve = DivideCurve(Curve=circles_2, Count=round.Nearest, Kinks=False)  # -> Points, Tangents, Parameters
negative = Negative(Value=series_2)
shift_list = ShiftList(List=divide_curve.Points, Shift=graft(series_2), Wrap=True)
shift_list_2 = ShiftList(List=divide_curve.Points, Shift=graft(negative), Wrap=True)
flip_matrix = FlipMatrix(Data=shift_list)
cull_index = CullIndex(List=circles_2, Indices=0, Wrap=True)
flip_matrix_2 = FlipMatrix(Data=shift_list_2)
interpolate = Interpolate(Vertices=flip_matrix_2, Degree=3, Periodic=False, KnotStyle=1)  # -> Curve, Length, Domain
interpolate_2 = Interpolate(Vertices=flip_matrix, Degree=3, Periodic=False, KnotStyle=1)  # -> Curve, Length, Domain
merge_2 = Merge(Data1=interpolate_2.Curve, Data2=interpolate.Curve, Data3=cull_index)
bambooth = Panel("0.01")
bambooradius = Panel("0.02")
pipe_2 = Pipe(Curve=merge_2, Radius=bambooradius, Caps=0, FitRail=False)
culms = Geometry(pipe_2)
curves = Geometry(merge_2)

hex = Geometry(offset_curve)

hex_2 = Geometry(hexculms)
culms_2 = Geometry(culms)
merge_3 = Merge(Data1=culms_2, Data2=hex_2)  # -> flatten(Result)
module = Geometry(merge_3)

hex_3 = Geometry(hex)

bambooth_2 = Panel(bambooradius)
bambooth_3 = Panel(bambooth)
subdivision_4 = Number(subdivision)
count_3 = Number(count_2)
circles_3 = Geometry(circles)
curves_2 = Geometry(curves)
expression_2 = Expression(x=bambooth_2, y=bambooth_3, Expression="x²*π-(x-y)²*π")
list_item_2 = ListItem(List=circles_3, Index=0, Wrap=True)
length = Length(Curve=curves_2)  # -> flatten(Length)
list_length = ListLength(List=flatten(curves_2))
panel = Panel("350")  # "kg/m3"
area = Area(Geometry=list_item_2)  # -> Area, Centroid
expression_3 = Expression(x=list_length, y=subdivision_4, Expression="(x-y)/2")
area_2 = Area(Geometry=hex_3)  # -> Area, Centroid
mass_addition = MassAddition(Input=length)  # -> Result, PartialResults
multiplication_3 = Multiplication(A=count_3, B=area_2.Area)
multiplication_4 = Multiplication(A=count_3, B=area.Area)
multiplication_5 = Multiplication(A=count_3, B=mass_addition.Result)
multiplication_6 = Multiplication(A=expression_2, B=multiplication_5)
multiplication_7 = Multiplication(A=multiplication_6, B=panel)
round_to_decimal_place = RoundToDecimalPlace(NumberX=multiplication_3, DecimalPlace=2, RoundType=0)  # -> Rounded, Difference
round_to_decimal_place_2 = RoundToDecimalPlace(NumberX=multiplication_4, DecimalPlace=2, RoundType=0)  # -> Rounded, Difference
round_to_decimal_place_3 = RoundToDecimalPlace(NumberX=multiplication_5, DecimalPlace=2, RoundType=0)  # -> Rounded, Difference
round_to_decimal_place_4 = RoundToDecimalPlace(NumberX=multiplication_7, DecimalPlace=2, RoundType=0)  # -> Rounded, Difference
multiplication_8 = Multiplication(A=count_3, B=list_length)
multiplication_9 = Multiplication(A=expression_3, B=subdivision_4, C=count_3)
coveredarea_m2 = Panel(round_to_decimal_place.Rounded)
footprintarea_m2 = Panel(round_to_decimal_place_2.Rounded)
culmscount = Panel(multiplication_8)
connectorscount = Panel(multiplication_9)
totallength_m = Panel(round_to_decimal_place_3.Rounded)
weight_kg = Panel(round_to_decimal_place_4.Rounded)
laborcost_module = Panel("1500")
cost_connector = Panel("5")
cost_m = Panel("3")
multiplication_10 = Multiplication(A=totallength_m, B=cost_m)
multiplication_11 = Multiplication(A=connectorscount, B=cost_connector)
multiplication_12 = Multiplication(A=count_3, B=laborcost_module)
addition = Addition(A=multiplication_10, B=multiplication_11, C=multiplication_12)
totalcost = Panel(addition)

module_2 = Geometry(module)
mirror = Mirror(Geometry=graft(module_2), Plane=construct_plane)  # -> Geometry, Transform
count_4 = Number(count_2)
series_3 = Series(Start=0, Step=1, Count=expr("x-1", count_4))
flip_matrix_3 = FlipMatrix(Data=mirror.Geometry)  # -> simplify(Data)
tree_branch = TreeBranch(Tree=flip_matrix_3, Path=series_3, MaintainPaths=True)
merge_4 = Merge(Data1=module_2, Data2=tree_branch)

context_print = ContextPrint(FootprintAreaM2=footprintarea_m2)
context_print_2 = ContextPrint(CoveredAreaM2=coveredarea_m2)
context_print_3 = ContextPrint(ConnectorsCount=connectorscount)
context_print_4 = ContextPrint(TotalWeightKg=weight_kg)
context_print_5 = ContextPrint(TotalLengthM=totallength_m)
context_print_6 = ContextPrint(CulmsCount=culmscount)
context_print_7 = ContextPrint(TotalCostE=totalcost)
context_bake = ContextBake(Geometry=merge_4)
