# Grasshopper definition box.gh (Grasshopper 1.0.8)

# ---- group: DEFAULT VALUES
length = Slider(9, range=0..50)
width = Slider(21, range=0..50)
height = Slider(16, range=0..50)

# ---- group: INPUTS
get_file_path = GetFilePath(AtLeast=1, AtMost=1, TreeAccess=False)
length_2 = GetInteger(length, AtLeast=1, AtMost=1, Maximum=2147483647, Minimum=-2147483648, TreeAccess=False)
width_2 = GetInteger(width, AtLeast=1, AtMost=1, Maximum=2147483647, Minimum=-2147483648, TreeAccess=False)
height_2 = GetInteger(height, AtLeast=1, AtMost=1, Maximum=2147483647, Minimum=-2147483648, TreeAccess=False)

# ----
rectangle = Rectangle(Plane=PlaneXY(0, 0, 0), XSize=length_2, YSize=width_2, Radius=0)  # -> Rectangle, Length
box_rectangle = BoxRectangle(Rectangle=rectangle.Rectangle, Height=height_2)
volume = Volume(Geometry=box_rectangle)  # -> Volume, Centroid

# ---- group: OUTPUTS
context_bake = ContextBake(Geometry=box_rectangle)
context_print = ContextPrint(Volume=volume.Volume)
context_bake_2 = ContextBake(Centroid=volume.Centroid)
