# Grasshopper definition bubblemesh.gh (Grasshopper 1.0.8)

mesh_sphere_ex = MeshSphereEx(Base=PlaneXY(0, 0, 0), Radius=10, Count=5)
mplane = MeshPlane(
    Boundary={Plane=PlaneXY(0, 0, 0), Size=Domain2(u=-10..10, v=-10..10)},
    WidthCount=Slider(50, range=0..100),
    HeightCount=Slider(50, range=0..100))  # -> Mesh, Area
panel = Panel(mplane.Mesh)
popgeo = PopulateGeometry(Geometry=mplane.Mesh, Count=Slider(10, range=0..10), Seed=Slider(39860, range=0..100000))
demesh = DeconstructMesh(Mesh=mplane.Mesh)  # -> Vertices, Faces, Colours, Normals
pull = PullPoint(Point=demesh.Vertices, Geometry=popgeo, ClosestOnly=True)  # -> ClosestPoint, Distance, Index
line = Line(StartPoint=demesh.Vertices, EndPoint=pull.ClosestPoint)
bnd = Bounds(Numbers=pull.Distance)
remap = RemapNumbers(Value=pull.Distance, Source=bnd, Target=Domain(0, 1))  # -> Mapped, Clipped
graph = GraphMapper(
    remap.Mapped,
    x0=0,
    x1=1,
    y0=0,
    y1=1,
    container_name="Sine",
    Equation_px=[0.5437462926, 1],
    Equation_py=[0.05235934258, 0.7308296561])
multiplication = Multiplication(A=demesh.Normals, B=graph, C=Slider(1, range=1..10))
colour_hsv = ColourHSV(Alpha=1, Hue=graph, Saturation=1, Value=1)
move = Move(Geometry=demesh.Vertices, Motion=multiplication)  # -> Geometry, Transform
conmesh = ConstructMesh(Vertices=move.Geometry, Faces=demesh.Faces, Colours=colour_hsv)
number_slider = Slider(100, range=0..100)
