# Grasshopper definition cbdm-01-CharlesAbiChahine.gh (Grasshopper 1.0.8)

number_slider = Slider(19, range=10..20)

# ---- group: inputs
width = GetNumber(Slider(50, range=1..100), AtLeast=1, AtMost=1, Maximum=1.797693135e+308, Minimum=-1.797693135e+308, TreeAccess=False)
length = GetNumber(Slider(48, range=1..100), AtLeast=1, AtMost=1, Maximum=1.797693135e+308, Minimum=-1.797693135e+308, TreeAccess=False)
u_count = GetNumber(number_slider, AtLeast=1, AtMost=1, Maximum=1.797693135e+308, Minimum=-1.797693135e+308, TreeAccess=False)
v_count = GetNumber(Slider(14, range=10..20), AtLeast=1, AtMost=1, Maximum=1.797693135e+308, Minimum=-1.797693135e+308, TreeAccess=False)
start = GetNumber(Slider(10, range=0..10), AtLeast=1, AtMost=1, Maximum=1.797693135e+308, Minimum=-1.797693135e+308, TreeAccess=False)
end = GetNumber(Slider(30, range=0..100), AtLeast=1, AtMost=1, Maximum=1.797693135e+308, Minimum=-1.797693135e+308, TreeAccess=False)
seed = GetNumber(Slider(18, range=0..100), AtLeast=1, AtMost=1, Maximum=1.797693135e+308, Minimum=-1.797693135e+308, TreeAccess=False)

# ----
construct_domain = ConstructDomain(DomainStart=width, DomainEnd=expr("-x", width))
construct_domain_2 = ConstructDomain(DomainStart=length, DomainEnd=expr("-x", length))
rectangle = Rectangle(Plane=PlaneXY(0, 0, 0), XSize=construct_domain, YSize=construct_domain_2, Radius=0)  # -> Rectangle, Length
divide_surface = DivideSurface(Surface=rectangle.Rectangle, UCount=u_count, VCount=v_count)  # -> flatten(Points), flatten(Normals), Parameters
construct_domain_3 = ConstructDomain(DomainStart=start, DomainEnd=end)
list_length = ListLength(List=divide_surface.Points)
random = Random(Range=construct_domain_3, Number=list_length, Seed=seed)
amplitude = Amplitude(Vector=divide_surface.Normals, Amplitude=random)
move = Move(Geometry=divide_surface.Points, Motion=amplitude)  # -> Geometry, Transform
list_length_2 = ListLength(List=move.Geometry)
surface_from_points = SurfaceFromPoints(Points=move.Geometry, UCount=expr("x+1", number_slider), Interpolate=False)
concatenate = Concatenate(Fragment_A="the surface has ", Fragment_B=list_length_2, A=" control points")
panel = Panel(concatenate)

# ---- group: outputs
context_print = ContextPrint(NumberOfControlPoints=concatenate)
context_bake = ContextBake(Content=surface_from_points)
