# Grasshopper definition cbdm-assign-01-em.gh (Grasshopper 1.0.8)
# plug-ins: Pufferfish

xy_plane = XYPlane(Origin=Point(0, 0, 0))

# ---- group: base dim
radius = GetNumber(Slider(55, range=5..80), AtLeast=1, AtMost=1, Maximum=1.797693135e+308, Minimum=-1.797693135e+308, TreeAccess=False)
number_of_segments = GetNumber(Slider(8, range=3..8), AtLeast=1, AtMost=1, Maximum=1.797693135e+308, Minimum=-1.797693135e+308, TreeAccess=False)

# ----
polygon = Polygon(Plane=xy_plane, Radius=radius, Segments=number_of_segments, FilletRadius=0)  # -> Polygon, Length
deconstruct_brep = DeconstructBrep(Brep=polygon.Polygon)  # -> Faces, Edges, Vertices
curve_middle = CurveMiddle(Curve=deconstruct_brep.Edges)

# ---- group: concave
concave_factor = GetNumber(Slider(1, range=0.1..1), AtLeast=1, AtMost=1, Maximum=1.797693135e+308, Minimum=-1.797693135e+308, TreeAccess=False)

# ----
polyline = PolyLine(Vertices=curve_middle, Closed=Toggle(True))
area = Area(Geometry=polyline)  # -> Area, Centroid
scale = Scale(Geometry=polyline, Center=area.Centroid, Factor=concave_factor)  # -> Geometry, Transform
deconstruct_brep_2 = DeconstructBrep(Brep=scale.Geometry)  # -> Faces, Edges, Vertices

# ---- group: floors
numbers_of_floors = GetNumber(Slider(30, range=0..100), AtLeast=1, AtMost=1, Maximum=1.797693135e+308, Minimum=-1.797693135e+308, TreeAccess=False)

# ----
end_points = EndPoints(Curve=deconstruct_brep.Edges)  # -> Start, End
merge = Merge(
    Data1=simplify(graft(end_points.Start)),
    Data2=simplify(graft(deconstruct_brep_2.Vertices)),
    Data3=simplify(graft(end_points.End)))
interpolate = Interpolate(Vertices=merge, Degree=3, Periodic=False, KnotStyle=1)  # -> Curve, Length, Domain
series = Series(Start=Slider(10, range=0..10), Step=Slider(10, range=0..10), Count=numbers_of_floors)
range = Range(Domain=Domain(0, 1), Steps=expr("x-1", numbers_of_floors))
join_curves = JoinCurves(Curves=flatten(interpolate.Curve), Preserve=False)
panel = Panel(series)
graph_mapper = GraphMapper(range, x0=0, x1=1, y0=0, y1=1, container_name="Sine", Equation_px=[0, 0.5090002418], Equation_py=[0, 1])

# ---- group: twist
twist_strength = GetNumber(Slider(86, range=0..100), AtLeast=1, AtMost=1, Maximum=1.797693135e+308, Minimum=-1.797693135e+308, TreeAccess=False)

# ----
unit_z = UnitZ(Factor=panel)
panel_2 = Panel(graph_mapper)
move = Move(Geometry=join_curves, Motion=unit_z)  # -> Geometry, Transform
multiplication = Multiplication(A=panel_2, B=twist_strength)
panel_3 = Panel(multiplication)
list_indices = ListIndices(List=panel_3)
rotate = Rotate(Geometry=move.Geometry, Angle=degrees(panel_3), Plane=PlaneXY(0, 0, 0))  # -> Geometry, Transform
concatenate = Concatenate(Fragment_A="floor ", Fragment_B=list_indices, Fragment_C=" has a rotation of ", Fragment_D=panel_3)
loft = Loft(Curves=rotate.Geometry, Options={Adjust=False, Closed=False, LoftEnds=0, LoftSimp=0, LoftType=0, Rebuild=10, Refit=0.01})
panel_4 = Panel(concatenate)

# ---- group: output
context_bake = ContextBake(Content=loft)
context_print = ContextPrint(Text=panel_4)
