# Grasshopper definition hops_test.gh (Grasshopper 1.0.8)
# plug-ins: Hops

file_path = FilePath("C:\Users\ecori\source\iaac\datamgmt-session01\bamb_u.gh")
hops = Hops(
    _Path=file_path,
    Diameter=Slider(4.3, range=3..6),
    Height=Slider(3.8, range=2..5),
    Subdivision=Slider(3, range=3..5),
    Count=Slider(7, range=2..7),
    Offset=Slider(0.1, range=0..0.5),
    CacheResultsInMemory=True,
    CacheSolveResults=True,
    RemoteDefinitionLocation="C:\Users\ecori\source\iaac\datamgmt-session01\bamb_u.gh",
    RemoteSolveVersion=(0, 1, 0),
    ShowInput_Enabled=False,
    ShowInput_Path=True,
    SynchronousSolve=True)  # -> Geometry, CoveredAreaM2, FootprintAreaM2, CulmsCount, ConnectorsCount, TotalLengthM, TotalCostE, TotalWeightKg
