# Grasshopper definition linear stairs generator.gh (Grasshopper 1.0.8)
# plug-ins: eleFront5

X = UnitX(Factor=1)

L = GetNumber(
    Slider(6.92, range=0.3..10),
    AtLeast=1,
    AtMost=1,
    Maximum=1.797693135e+308,
    Minimum=-1.797693135e+308,
    Prompt="Total lenght of the staircase",
    TreeAccess=False)
G = GetNumber(
    Slider(0.3, range=0.1..1),
    AtLeast=1,
    AtMost=1,
    Maximum=1.797693135e+308,
    Minimum=-1.797693135e+308,
    Prompt="Approximate lenght of step's going",
    TreeAccess=False)
W = GetNumber(
    Slider(2.35, range=0.5..14),
    AtLeast=1,
    AtMost=1,
    Maximum=1.797693135e+308,
    Minimum=-1.797693135e+308,
    Prompt="Stair's width",
    TreeAccess=False)
H = GetNumber(
    Slider(4.2, range=0.1..15),
    AtLeast=1,
    AtMost=1,
    Maximum=1.797693135e+308,
    Minimum=-1.797693135e+308,
    Prompt="Stair's total height",
    TreeAccess=False)
st = GetNumber(
    Slider(0.08, range=0.01..0.5),
    AtLeast=1,
    AtMost=1,
    Maximum=1.797693135e+308,
    Minimum=-1.797693135e+308,
    Prompt="Step Thickness",
    TreeAccess=False)

pt = ConstructPoint(XCoordinate=0, YCoordinate=0, ZCoordinate=0)
line = LineSDL(Start=pt, Direction=X, Length=L)
len = Length(Curve=line)
division = Division(A=len, B=G)
number_of_steps = Integer(division)
division_2 = Division(A=H, B=number_of_steps)
number_of_steps_2 = Panel(number_of_steps)
steps_rise = Panel(division_2)
division_3 = Division(A=len, B=number_of_steps)
divide = DivideCurve(Curve=line, Count=number_of_steps, Kinks=False)  # -> flatten(Points), Tangents, Parameters
panel = Panel(number_of_steps_2)
actual_lenght_of_step_s_going = Panel(division_3)
dom = ConstructDomain(DomainStart=division_2, DomainEnd=H)
Y = UnitY(Factor=W)
shift = ShiftList(List=divide.Points, Shift=1, Wrap=True)
ln = Line(StartPoint=graft(divide.Points), EndPoint=graft(shift))
range = Range(Domain=dom, Steps=expr("x-1", panel))
panel_2 = Panel(dom)
cull_i = CullIndex(List=flatten(ln), Indices="-1", Wrap=True)  # -> graft(List)
panel_3 = Panel(range)
explode = Explode(Curve=ln, Recursive=True)  # -> Segments, Vertices
extr = Extrude(Base=cull_i, Direction=Y)
Z = UnitZ(Factor=range)
Z_2 = UnitZ(Factor=1)
move = Move(Geometry=extr, Motion=graft(Z))  # -> Geometry, Transform
Z_3 = UnitZ(Factor=st)
actual_lenght_of_step_s_going_2 = EleFrontDataDescription(actual_lenght_of_step_s_going, ShiftDepth=0, isNameSet=False)
extr_2 = Extrude(Base=move.Geometry, Direction=expr("-x", Z_3))  # -> flatten(Extrusion)
number_of_steps_3 = EleFrontDataDescription(panel, ShiftDepth=0, isNameSet=True)
steps_rise_2 = EleFrontDataDescription(steps_rise, ShiftDepth=0, isNameSet=False)
c_bake = ContextBake(Content=extr_2)
number_of_steps_4 = ContextPrint(Text=number_of_steps_3)
number_of_steps_5 = ContextPrint(Text=actual_lenght_of_step_s_going_2)
number_of_steps_6 = ContextPrint(Text=steps_rise_2)
