# Grasshopper definition panelization.gh (Grasshopper 1.0.8)
# plug-ins: Weaverbird

# ----
# Default Values
number_of_panels = Slider(6, range=0..100)
panel_thickness = Slider(0.5, range=0..10)
u_panels = Slider(7, range=0..20)
panel_depth = Slider(4, range=0..100)
panel_rotation = Slider(0, range=0..180)
roof_extents = Slider(70, range=0..100)
frequency = Slider(7, range=0..10)
v_panels = Slider(1, range=0..20)
amplitude = Slider(5, range=0..10)
curve = Curve([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])

# ----
# Inputs
number_of_panels_2 = GetNumber(number_of_panels, AtLeast=1, AtMost=1, Maximum=1.797693135e+308, Minimum=-1.797693135e+308, TreeAccess=False)
panel_thickness_2 = GetNumber(panel_thickness, AtLeast=1, AtMost=1, Maximum=1.797693135e+308, Minimum=-1.797693135e+308, TreeAccess=False)
panel_rotation_2 = GetNumber(panel_rotation, AtLeast=1, AtMost=1, Maximum=1.797693135e+308, Minimum=-1.797693135e+308, TreeAccess=False)
roof_extents_2 = GetNumber(roof_extents, AtLeast=1, AtMost=1, Maximum=1.797693135e+308, Minimum=-1.797693135e+308, TreeAccess=False)
panel_depth_2 = GetNumber(panel_depth, AtLeast=1, AtMost=1, Maximum=1.797693135e+308, Minimum=-1.797693135e+308, TreeAccess=False)
u_panels_2 = GetNumber(u_panels, AtLeast=1, AtMost=1, Maximum=1.797693135e+308, Minimum=-1.797693135e+308, TreeAccess=False)
frequency_2 = GetNumber(frequency, AtLeast=1, AtMost=1, Maximum=1.797693135e+308, Minimum=-1.797693135e+308, TreeAccess=False)
v_panels_2 = GetNumber(v_panels, AtLeast=1, AtMost=1, Maximum=1.797693135e+308, Minimum=-1.797693135e+308, TreeAccess=False)
amplitude_2 = GetNumber(amplitude, AtLeast=1, AtMost=1, Maximum=1.797693135e+308, Minimum=-1.797693135e+308, TreeAccess=False)
line = GetLine(curve, AtLeast=1, AtMost=1, Realtime=True, TreeAccess=False)

# ----
# Roof Extents
roof_extents_3 = Number(roof_extents_2)
list_item = ListItem(List=line, Index=0, Wrap=True)  # -> Item, Item1, Item2
entwine = Entwine(Branch00=list_item.Item1, Branch01=list_item.Item2, FlattenInputs=True)
unit_x = UnitX(Factor=roof_extents_3)
move = Move(Geometry=entwine, Motion=unit_x)  # -> Geometry, Transform
param_viewer = ParamViewer(entwine)
curve_2 = Curve(move.Geometry)
curve_3 = Curve(entwine)

merge = Merge(Data1=curve_2, Data2=curve_3)

# ----
# Create Panels
number_of_panels_3 = Number(number_of_panels_2)
divide_curve = DivideCurve(Curve=merge, Count=number_of_panels_3, Kinks=False)  # -> Points, Tangents, Parameters
param_viewer_2 = ParamViewer(divide_curve.Points)
split_tree = SplitTree(Data=divide_curve.Points, Masks=flatten("{0;*;0}"))  # -> Positive, Negative
panel = Panel(divide_curve.Points)
line_2 = Line(StartPoint=split_tree.Positive, EndPoint=split_tree.Negative)
split_tree_2 = SplitTree(Data=line_2, Masks=flatten("{0;1;0}"))  # -> Positive, Negative
panel_depth_3 = Number(panel_depth_2)
expression = Expression(x=panel_depth_3, Expression="-x")
unit_y = UnitY(Factor=panel_depth_3)
unit_y_2 = UnitY(Factor=expression)
move_2 = Move(Geometry=split_tree_2.Negative, Motion=unit_y)  # -> Geometry, Transform
move_3 = Move(Geometry=split_tree_2.Positive, Motion=unit_y_2)  # -> Geometry, Transform
ruled_surface = RuledSurface(CurveA=[move_2.Geometry, move_3.Geometry], CurveB=[split_tree_2.Positive, split_tree_2.Negative])

# ----
# Rotate Panels
panel_rotation_3 = Number(panel_rotation_2)
param_viewer_3 = ParamViewer(ruled_surface)
expression_2 = Expression(x=panel_rotation_3, Expression="x * π/180")
split_tree_3 = SplitTree(Data=ruled_surface, Masks=flatten("{0;1;0}"))  # -> Positive, Negative
area = Area(Geometry=split_tree_3.Positive)  # -> Area, Centroid
area_2 = Area(Geometry=split_tree_3.Negative)  # -> Area, Centroid
expression_3 = Expression(x=expression_2, Expression="-x")
yz_plane = YZPlane(Origin=Point(0, 0, 0))
rotate_3d = Rotate3D(Geometry=split_tree_3.Negative, Angle=expression_3, Center=area_2.Centroid, Axis=yz_plane)  # -> Geometry, Transform
rotate_3d_2 = Rotate3D(Geometry=split_tree_3.Positive, Angle=expression_2, Center=area.Centroid, Axis=yz_plane)  # -> Geometry, Transform
merge_2 = Merge(Data1=rotate_3d_2.Geometry, Data2=rotate_3d.Geometry)

# ----
# Wave Panels
param_viewer_4 = ParamViewer(merge_2)
u_panels_3 = Number(u_panels_2)
v_panels_3 = Number(v_panels_2)
mesh_surface = MeshSurface(Surface=merge_2, UCount=u_panels_3, VCount=v_panels_3, Overhang=True, Equalize=False)
deconstruct_mesh = DeconstructMesh(Mesh=mesh_surface)  # -> Vertices, Faces, Colours, Normals
deconstruct = Deconstruct(Point=deconstruct_mesh.Vertices)  # -> XComponent, YComponent, ZComponent
amplitude_3 = Number(amplitude_2)
frequency_3 = Number(frequency_2)
param_viewer_5 = ParamViewer(deconstruct_mesh.Vertices)
expression_4 = Expression(x=deconstruct.XComponent, y=frequency_3, z=amplitude_3, Expression="sin(x*y)* z")
addition = Addition(A=deconstruct.ZComponent, B=expression_4)
panel_2 = Panel(addition)
construct_point = ConstructPoint(XCoordinate=deconstruct.XComponent, YCoordinate=deconstruct.YComponent, ZCoordinate=addition)
construct_mesh = ConstructMesh(Vertices=construct_point, Faces=deconstruct_mesh.Faces)

deconstruct_2 = Deconstruct(Point=deconstruct_mesh.Vertices)  # -> XComponent, YComponent, ZComponent
panel_3 = Panel(frequency_3)
panel_thickness_3 = Number(panel_thickness_2)

# ----
# Mesh Thickness
panel_4 = Panel("{*;1;*;*}")
split_tree_4 = SplitTree(Data=construct_mesh, Masks=flatten(panel_4))  # -> Positive, Negative
negative = Negative(Value=panel_thickness_3)
weaverbird_s_mesh_thicken = WeaverbirdsMeshThicken(MeshCurves=split_tree_4.Positive, Distance=panel_thickness_3, OffsetType=0)
weaverbird_s_mesh_thicken_2 = WeaverbirdsMeshThicken(MeshCurves=split_tree_4.Negative, Distance=panel_thickness_3, OffsetType=0)
merge_3 = Merge(Data1=weaverbird_s_mesh_thicken, Data2=weaverbird_s_mesh_thicken_2)
custom_preview = CustomPreview(Geometry=merge_3, Material=ColourSwatch(SwatchColor=RGB(88, 177, 104)))

# ----
# Outputs
context_bake = ContextBake(Geometry=merge_3)
