# Grasshopper definition SpikeyThing_start.gh (Grasshopper 1.0.8)
# Spherical spikey thing

# ----
# Default values
cell_radius = Slider(5, range=0..10)

# ----
# Inputs
radius = Data(cell_radius)
count = Data(Slider(16, range=1..100))
length = Data(Slider(20, range=1..20))
construct_point = ConstructPoint(XCoordinate=0, YCoordinate=0, ZCoordinate=0)
mesh_sphere = MeshSphere(Base=construct_point, Radius=radius, UCount=10, VCount=20)
populate_geometry = PopulateGeometry(Geometry=mesh_sphere, Count=count, Seed=1)
facet_dome = FacetDome(Points=populate_geometry, Radius=radius)  # -> Pattern, Dome
explode = Explode(Curve=facet_dome.Pattern, Recursive=True)  # -> Segments, Vertices
point_on_curve = PointOnCurve(explode.Segments, parameter=0.5)
average = Average(Input=point_on_curve)
vector_2pt = Vector2Pt(PointA=construct_point, PointB=average, Unitize=invert(False))  # -> Vector, Length
list_length = ListLength(List=explode.Segments)
amplitude = Amplitude(Vector=vector_2pt.Vector, Amplitude=length)
addition = Addition(A=average, B=amplitude)
end_points = EndPoints(Curve=graft(explode.Segments))  # -> Start, End
duplicate_data = DuplicateData(Data=addition, Number=list_length, Order=True)
shift_paths = ShiftPaths(Data=duplicate_data, Offset=-1)  # -> graft(Data)
mesh_triangle = MeshTriangle(CornerA=0, CornerB=1, CornerC=2)
merge = Merge(Data1=end_points.Start, Data2=end_points.End, Data3=shift_paths)
construct_mesh = ConstructMesh(Vertices=merge, Faces=mesh_triangle)
mesh_join = MeshJoin(Meshes=flatten(construct_mesh))
align_vertices = AlignVertices(Mesh=mesh_join, Tolerance=0.1)  # -> Result, Count
weld_mesh = WeldMesh(Mesh=align_vertices.Result, Angle=3.141592654)
subd_from_mesh = SubDFromMesh(Mesh=weld_mesh, Creases=1, Corners=1, Interpolate=False)
deconstruct_mesh = DeconstructMesh(Mesh=subd_from_mesh)  # -> Vertices, Faces, Colours, Normals
list_length_2 = ListLength(List=deconstruct_mesh.Faces)
concatenate = Concatenate(Fragment_A="Spiky thing has ", Fragment_B=list_length_2, A=" faces")
panel = Panel(concatenate)
# Outputs
subd = SubD(subd_from_mesh)
