# Grasshopper definition tower_ramyayoub.gh (Grasshopper 1.0.8)

construct_point = ConstructPoint(XCoordinate=0, YCoordinate=0, ZCoordinate=0)
construct_point_2 = ConstructPoint(XCoordinate=0, YCoordinate="25", ZCoordinate=0)
catenary = Catenary(PointA=construct_point, PointB=construct_point_2, Length="81", Gravity="0,0,1")
line = Line(StartPoint=construct_point, EndPoint=construct_point_2)

unit_x = UnitX(Factor=Slider(96, range=0..100))
unit_x_2 = UnitX(Factor=Slider(42, range=0..100))

m_a_y = GetNumber(
    Slider(1, range=0..1),
    AtLeast=1,
    AtMost=1,
    Maximum=1.797693135e+308,
    Minimum=-1.797693135e+308,
    Prompt="middle arc deforation on y ",
    TreeAccess=False)
m_a_z = GetNumber(
    Slider(0.34, range=0..1),
    AtLeast=1,
    AtMost=1,
    Maximum=1.797693135e+308,
    Minimum=-1.797693135e+308,
    Prompt="middle arc deforation on z",
    TreeAccess=False)

h_a_x = GetNumber(
    Slider(1, range=0..1),
    AtLeast=1,
    AtMost=1,
    Maximum=1.797693135e+308,
    Minimum=-1.797693135e+308,
    Prompt="higher arc deforation on x",
    TreeAccess=False)
h_a_y = GetNumber(
    Slider(1, range=0..1),
    AtLeast=1,
    AtMost=1,
    Maximum=1.797693135e+308,
    Minimum=-1.797693135e+308,
    Prompt="higher arc deforation on y",
    TreeAccess=False)
h_a_z = GetNumber(
    Slider(0.61, range=0..1),
    AtLeast=1,
    AtMost=1,
    Maximum=1.797693135e+308,
    Minimum=-1.797693135e+308,
    Prompt="higher arc deforation on z",
    TreeAccess=False)

move = Move(Geometry=line, Motion=unit_x_2)  # -> Geometry, Transform
move_2 = Move(Geometry=line, Motion=unit_x)  # -> Geometry, Transform

get_number = GetNumber(
    Slider(0.7, range=0..1),
    AtLeast=1,
    AtMost=1,
    Maximum=1.797693135e+308,
    Minimum=-1.797693135e+308,
    Prompt="lower arc deforation",
    TreeAccess=False)

move_3 = Move(Geometry=catenary, Motion=unit_x_2)  # -> Geometry, Transform
move_4 = Move(Geometry=catenary, Motion=unit_x)  # -> Geometry, Transform
point_on_curve = PointOnCurve(move.Geometry, parameter=0.563)
point_on_curve_2 = PointOnCurve(line, parameter=0.502)
point_on_curve_3 = PointOnCurve(move_2.Geometry, parameter=0.85)
scale_nu = ScaleNU(Geometry=catenary, Plane=point_on_curve_2, ScaleX=Slider(1, range=0..1), ScaleY=Slider(1, range=0..1), ScaleZ=get_number)  # -> Geometry, Transform
scale_nu_2 = ScaleNU(Geometry=move_3.Geometry, Plane=point_on_curve, ScaleX=Slider(0.43, range=0..1), ScaleY=m_a_y, ScaleZ=m_a_z)  # -> Geometry, Transform
scale_nu_3 = ScaleNU(Geometry=move_4.Geometry, Plane=point_on_curve_3, ScaleX=h_a_x, ScaleY=h_a_y, ScaleZ=h_a_z)  # -> Geometry, Transform

vert_lines = GetNumber(
    Slider(20, range=0..20),
    AtLeast=1,
    AtMost=1,
    Maximum=1.797693135e+308,
    Minimum=-1.797693135e+308,
    Prompt="number of vertical lines of the tower",
    TreeAccess=False)

loft_options = LoftOptions(Closed=False, Adjust=False, Rebuild="3", Refit=0, Type=0)

horiz_lines = GetNumber(
    Slider(20, range=0..20),
    AtLeast=1,
    AtMost=1,
    Maximum=1.797693135e+308,
    Minimum=-1.797693135e+308,
    Prompt="number ofhoriz lines of the tower",
    TreeAccess=False)

construct_domain = ConstructDomain(DomainStart=Slider(6, range=0..100), DomainEnd=Slider(87, range=0..100))
loft = Loft(Curves=[scale_nu.Geometry, scale_nu_2.Geometry, scale_nu_3.Geometry], Options=loft_options)
divide_domain² = DivideDomain²(Domain=loft, UCount="1", VCount=vert_lines)
divide_domain²_2 = DivideDomain²(Domain=loft, UCount=horiz_lines, VCount="1")
random = Random(Range=construct_domain, Number=horiz_lines, Seed=2)
isotrim = Isotrim(Surface=loft, Domain=divide_domain²)
isotrim_2 = Isotrim(Surface=loft, Domain=divide_domain²_2)
divide_domain²_3 = DivideDomain²(Domain=isotrim_2, UCount="1", VCount=random)

curtainglass = GetNumber(
    Slider(24, range=0..100),
    AtLeast=1,
    AtMost=1,
    Maximum=1.797693135e+308,
    Minimum=-1.797693135e+308,
    Prompt="random reduce of curtain glass",
    TreeAccess=False)

deconstruct_brep = DeconstructBrep(Brep=isotrim)  # -> Faces, Edges, Vertices
deconstruct_brep_2 = DeconstructBrep(Brep=isotrim_2)  # -> Faces, Edges, Vertices
isotrim_3 = Isotrim(Surface=graft(isotrim_2), Domain=divide_domain²_3)

pipe = Pipe(Curve=deconstruct_brep.Edges, Radius="0.03", Caps=0)
pipe_2 = Pipe(Curve=deconstruct_brep_2.Edges, Radius="0.03", Caps=0)
random_reduce = RandomReduce(List=isotrim_3, Reduction=curtainglass, Seed=1)

merge = Merge(Data1=pipe, Data2=pipe_2, Data3=random_reduce)  # -> flatten(Result)
colour_swatch = ColourSwatch(SwatchColor=RGB(255, 255, 255))  # disabled
xy_plane = XYPlane(Origin=Point(0, 0, 0))
custom_preview = CustomPreview(Geometry=merge, Material=colour_swatch)  # disabled
mirror = Mirror(Geometry=merge, Plane=xy_plane)  # -> Geometry, Transform
merge_2 = Merge(Data1=mirror.Geometry, Data2=merge)
xz_plane = XZPlane(Origin=Point(0, 0, 0))
rotate = Rotate(Geometry=merge_2, Angle=1.570796327, Plane=xz_plane)  # -> Geometry, Transform
brep = Brep(rotate.Geometry)
context_bake = ContextBake(Content=brep)
