# Grasshopper definition vase.gh (Grasshopper 1.0.8)

height = GetNumber(Slider(1, range=1..5), AtLeast=1, AtMost=1, Maximum=1.797693135e+308, Minimum=-1.797693135e+308, TreeAccess=False)
series = Series(Start=0, Step=height, Count=3)
unit_z = UnitZ(Factor=series)
circle = Circle(Plane=PlaneXY(0, 0, 0), Radius=1)
move = Move(Geometry=circle, Motion=unit_z)  # -> flatten(Geometry), Transform
curvature = GetNumber(Slider(3, range=3..100), AtLeast=1, AtMost=1, Maximum=1.797693135e+308, Minimum=-1.797693135e+308, TreeAccess=False)
list_item = ListItem(List=move.Geometry, Index=0, Wrap=True)  # -> Item, Item1, Item2
divide_curve = DivideCurve(Curve=list_item.Item1, Count=curvature, Kinks=False)  # -> Points, Tangents, Parameters
divide_curve_2 = DivideCurve(Curve=list_item.Item, Count=curvature, Kinks=False)  # -> Points, Tangents, Parameters
divide_curve_3 = DivideCurve(Curve=list_item.Item2, Count=curvature, Kinks=False)  # -> Points, Tangents, Parameters
shift_list = ShiftList(List=divide_curve_3.Points, Shift=Slider(4, range=0..10), Wrap=True)
shift_list_2 = ShiftList(List=divide_curve.Points, Shift=Slider(2, range=0..10), Wrap=True)
shift_list_3 = ShiftList(List=divide_curve_2.Points, Shift=Slider(5, range=0..10), Wrap=True)
merge = Merge(Data1=shift_list_3, Data2=shift_list_2, Data3=shift_list)
partition_list = PartitionList(List=merge, Size=curvature)
flip_matrix = FlipMatrix(Data=partition_list)
interpolate = Interpolate(Vertices=flip_matrix, Degree=3, Periodic=False, KnotStyle=1)  # -> Curve, Length, Domain
curve = Curve(flatten(interpolate.Curve))
loft = Loft(Curves=curve, Options={Adjust=False, Closed=True, LoftEnds=0, LoftSimp=0, LoftType=0, Rebuild=10, Refit=0.01})
context_bake = ContextBake(Content=loft)
